# Grasshopper definition direct_send.gh (Grasshopper 1.0.7)

panel = Panel("""def ur_script():
 
 set_tcp(p[0.0, 0.0, 0.0, 0.0, 3.14159, 0.0])
 
 movel(p[0.400, 0.400, 0.400, 0.000, 0.000, 0.000], a = 0.1, v = 0.5)
 
 sleep(0.5) 
 set_digital_out(4, True)
 sleep(0.5)
 
 movel(p[0.400, 0.400, 0.200, 0.000, 0.000, 0.000], a = 0.1, v = 0.5)
 
 sleep(0.5) 
 set_digital_out(4, False)
 sleep(0.5)
 
 movel(p[0.400, 0.200, 0.400, 0.000, 0.000, 0.000], a = 0.1, v = 0.5)
 
 sleep(0.5) 
 set_digital_out(4, True)
 sleep(0.5) 
movel(p[0.400, 0.400, 0.400, 0.000, 0.000, 0.000], a = 0.1, v = 0.5)
 
 sleep(0.5) 
 set_digital_out(4, True)
 sleep(0.5)
 
end
 
ur_script()""")
python = GhPythonScript(execute=Toggle(False))  # -> out, a; inputs execute: Boolean
# ---------- python: Python ----------
__author__ = "jennyd"
__version__ = "2018.10.02"


import socket

file_path = 'C:\\Users\\apetrus\\Documents\\UR_basic\\URScriptSender\\'
file_name = 'test_script.txt'
 
robot_ip = '192.168.10.10'
script = ''

UR_SERVER_PORT = 30002

def send_script(ur_ip, script):
    global UR_SERVER_PORT
    s = socket.create_connection((ur_ip, UR_SERVER_PORT), timeout=2) 
    s.send(script)
    print "Script sent to %s on port %i" % (ur_ip, UR_SERVER_PORT)
    s.close()

execute= True

if execute:
    path = file_path+file_name
    
    file = open(file_path+file_name, 'r')
    file_lines = file.readlines()
    file.close()
    
    for line in file_lines:
        script += line
    
    print script
    
    #send_script(robot_ip,script)
# ---------- end python ----------
sender = GhPythonScript(script=panel, execute=Toggle(True))  # -> out, a
# ---------- sender: Python ----------
__author__  = 'petrus'
__version__ = '2020.10.09'


import socket                   # module for network comunication

robot_ip = '192.168.10.10'      # numerical label assigned to the UR robotic arm
UR_SERVER_PORT = 30002          # identifier for the socket comunication


def send_script(ur_ip, script):
    #global UR_SERVER_PORT
    s = socket.create_connection((ur_ip, UR_SERVER_PORT), timeout=2) #creates a connection between this computer and the robot. This computer must have an ip number that is the same except for the last two numbers. 
    s.send(script)
    print ("Script sent to %s on port %i" % (ur_ip, UR_SERVER_PORT))
    s.close()



if execute:
    
    print (script)
    
    #send_script(robot_ip,script)
# ---------- end sender ----------
