# Grasshopper definition tutorial_2_distance_functions_from_scratch_PYTHON.gh (Grasshopper 1.0.7)
# plug-ins: Bifocals

# ---- group: Regular grid
number_slider = Slider(100, range=0..100)
# Sample points creation
sqgrid = Square(Plane=PlaneXY(0, 0, 0), Size=1, ExtentX=number_slider, ExtentY=number_slider)  # -> Cells, Points
pt = Point(flatten(sqgrid.Points))

# ----
neg = Negative(Value=Slider(100, range=0..100))

crv = Curve(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)
Z = UnitZ(Factor=Slider(100, range=0..100))
extr = Extrude(Base=crv, Direction=Z)
pop3d = Populate3D(Region=extr, Count=Slider(20000, range=0..100000), Seed=1)  # disabled

X = UnitX(Factor=neg)
move = Move(Geometry=pt, Motion=X)  # -> Geometry, Transform

pt_2 = Point(flatten([move.Geometry, pt]))

# ---- group: Sphere
pt_3 = Point(Point(15.48385712, 63.47085268, 0))
# Distance functions
sphere = GhPythonScript(r=Slider(9.24, range=0..100), c=pt_3)  # -> out, df; inputs c: Point3d
# ---------- sphere: Python ----------
import rhinoscriptsyntax as rs

class Sphere:
    def __init__(self, r, c):
        """
        r : float, radius
        c : Rhino.Geometry.Point3d, center
        """
        self.r = r
        self.c = c
        
    def get_distance(self, p):
        """
        p: Rhino.Geometry.Point3d, point to evaluate
        """
        distance = rs.Distance(p, self.c) - self.r
        return distance

df = Sphere(r, c)
# ---------- end sphere ----------

pt_4 = Point(Point(24.31018918, 42.15041148, 0))
sphere_2 = GhPythonScript(r=Slider(11.99, range=0..100), c=pt_4)  # -> out, df; inputs c: Point3d; same code as sphere

pt_5 = Point(Point(28.08962073, 48.04918532, 0))
sphere_3 = GhPythonScript(r=Slider(26.94, range=0..100), c=pt_5)  # -> out, df; inputs c: Point3d; same code as sphere

# ---- group: Box
pt_6 = Point(Point(36.392543, 60.52393869, 0))
box = GhPythonScript(
    h1=Slider(10, range=0..10),
    h2=Slider(57.51, range=0..100),
    h3=Slider(15.1, range=0..20),
    r=Slider(4, range=0..4),
    c=pt_6)  # -> out, df; inputs c: Point3d
# ---------- box: Python ----------
import rhinoscriptsyntax as rs
import math

class Box:
    def __init__(self, h1, h2, h3, r, c):
        self.h1 = h1
        self.h2 = h2
        self.h3 = h3
        self.r = r # radius of corner rounding
        self.c = c # Point3d, center
        
    def get_distance(self, p):
       x,y,z = p.X, p.Y, p.Z
       dx = abs(x - self.c.X) - (self.h1/2.0 - self.r)
       dy = abs(y - self.c.Y) - (self.h2/2.0 - self.r)
       dz = abs(z - self.c.Z) - (self.h3/2.0 - self.r)
       
       inside = max([dx, dy, dz])- self.r
       dx = max(dx, 0)
       dy = max(dy, 0)
       dz = max(dz, 0)
       
       if inside + self.r > 0:
           return math.sqrt(dx**2 + dy**2 + dz**2) - self.r
           
       else:
           return inside
       

df = Box(h1, h2, h3, r, c)
# ---------- end box ----------

# ----
smoothunion = GhPythonScript(df1=sphere.df, df2=box.df, r=Slider(26.8, range=0..100))  # -> out, df
# ---------- smoothunion: Python ----------
class SmoothUnion:
    def __init__(self, df1, df2, r):
        self.df1 = df1
        self.df2 = df2 
        self.r = r
        
    def get_distance(self, p):
        """
        p: Rhino.Geometry.Point3d, point to evaluate
        """
        distance1 = self.df1.get_distance(p)
        distance2 = self.df2.get_distance(p)
        
        e = max(self.r - abs(distance1 - distance2), 0)
        return min(distance1, distance2) - e*e*0.25/self.r
        
df = SmoothUnion(df1, df2, r)
# ---------- end smoothunion ----------
union = GhPythonScript()  # -> out, df
# ---------- union: Python ----------
class Union:
    def __init__(self, df1, df2):
        self.df1 = df1
        self.df2 = df2
        
    def get_distance(self, p):
        """
        p: Rhino.Geometry.Point3d, point to evaluate
        """
        distance1 = self.df1.get_distance(p)
        distance2 = self.df2.get_distance(p)
        return min(distance1, distance2)
        
df = Union(df1, df2)
# ---------- end union ----------
intersection = GhPythonScript()  # -> out, df
# ---------- intersection: Python ----------
class Union:
    def __init__(self, df1, df2):
        self.df1 = df1
        self.df2 = df2
        
    def get_distance(self, p):
        """
        p: Rhino.Geometry.Point3d, point to evaluate
        """
        distance1 = self.df1.get_distance(p)
        distance2 = self.df2.get_distance(p)
        return max(distance1, distance2)
        
df = Union(df1, df2)
# ---------- end intersection ----------
mirrory = GhPythonScript(df=smoothunion.df)  # -> out, df
# ---------- mirrory: Python ----------
import rhinoscriptsyntax as rs

class MirrorY:
    def __init__(self, df):
        self.df = df
        
        
    def get_distance(self, p):
        p.X = abs(p.X)
        distance = self.df.get_distance(p)
        return distance
        
df = MirrorY(df)
# ---------- end mirrory ----------

evaluation = GhPythonScript(df=mirrory.df, pts=pt_2)  # -> out, a; inputs pts: list of Point3d
# ---------- evaluation: Python ----------
import rhinoscriptsyntax as rs

a = []
for p in pts:
    distance = df.get_distance(p)
    a.append(distance)
# ---------- end evaluation ----------
distances = Number(evaluation.a)

bnd = Bounds(Numbers=distances)
# Visualization
number_slider_2 = Slider(0, range=0..100)

# ---- group: Interior points
smaller = SmallerThan(FirstNumber=distances, SecondNumber=Slider(0, range=0..100))  # -> SmallerThan, OrEqualTo
pt_7 = Point(pt_2)
dispatch = Dispatch(List=pt_7, DispatchPattern=smaller.OrEqualTo)  # -> ListA, ListB
pt_8 = Point(dispatch.ListA)

# ----
dedomain = DeconstructDomain(Domain=bnd)  # -> Start, End
gradient = Gradient(
    LowerLimit=number_slider_2,
    UpperLimit=dedomain.End,
    Parameter=distances,
    stops=[0: RGB(0, 128, 0), 0.112: RGB(255, 255, 0), 1: RGB(255, 0, 0)])
cloud = CloudDisplay(Points=pt_2, Colours=gradient, Size=Slider(0.61, range=0..10), SpriteType=1)
