# Grasshopper definition 01_sdf_from_scratch.gh (Grasshopper 1.0.7)

# ---- group: Random point samples
# explain what we are going to do today!
# 
# Show final result
number_slider = Slider(100, range=0..100)
# 1st part, pure grasshopper
rectangle = Rectangle(Plane=PlaneXY(0, 0, 0), XSize=number_slider, YSize=number_slider, Radius=0)  # -> Rectangle, Length
pop2d = Populate2D(Region=rectangle.Rectangle, Count=Slider(734, range=0..1000), Seed=1)

# ---- group: 3D box
number_slider_2 = Slider(41, range=0..100)
area = Area(Geometry=rectangle.Rectangle)  # -> Area, Centroid
box = CenterBox(Base=area.Centroid, X=number_slider_2, Y=number_slider_2, Z=number_slider_2)

# ---- group: Regular grid
number_slider_3 = Slider(100, range=0..100)
sqgrid = Square(Plane=PlaneXY(0, 0, 0), Size=Slider(1, range=0..10), ExtentX=number_slider_3, ExtentY=number_slider_3)  # -> Cells, Points
pt = Point(sqgrid.Points)

number_slider_4 = Slider(100, range=0..100)
sqgrid_2 = Square(Plane=PlaneXY(0, 0, 0), Size=Slider(1, range=0..10), ExtentX=number_slider_4, ExtentY=number_slider_4)  # -> Cells, Points
pt_2 = Point(flatten(sqgrid_2.Points))

# ----
# 2nd part, grasshopper-python
number_slider_5 = Slider(3000, range=0..10000)
pop3d = Populate3D(Region=box, Count=number_slider_5, Seed=1)
query_point = Point(flatten(pt))

# ---- group: sphere
center = Point(<point referenced from the Rhino model>)
dist = Distance(PointA=center, PointB=query_point)
radius = Data(Slider(11.78, range=0..100))
subtraction = Subtraction(A=dist, B=radius)

center_2 = Point(<point referenced from the Rhino model>)
dist_2 = Distance(PointA=center_2, PointB=query_point)
radius_2 = Data(Slider(23.87, range=0..100))
subtraction_2 = Subtraction(A=dist_2, B=radius_2)

# ---- group: pipe
curve = Curve(<curve referenced from the Rhino model>)
crv_cp = CurveClosestPoint(Point=flatten(query_point), Curve=curve)  # -> Point, Parameter, Distance
radius_3 = Data(Slider(5.36, range=0..10))
subtraction_3 = Subtraction(A=crv_cp.Distance, B=radius_3)

# ---- group: Sphere
pt_3 = Point(<point referenced from the Rhino model>)
sphere = GhPythonScript(r=Slider(6.65, range=0..10), c=pt_3)  # -> out, d; inputs c: Point3d
# ---------- sphere: Python ----------
import rhinoscriptsyntax as rs
import Rhino.Geometry as rg
import math

class Sphere:
    def __init__(self, r, c):
        self.r = r # float
        self.c = c # rg.Point3d
        
    def get_distance(self, p):
        d = rs.Distance(p, self.c) - r
        return d
        
d = Sphere(r, c)
# ---------- end sphere ----------

# ---- group: Box
pt_4 = Point(<point referenced from the Rhino model>)
box_2 = GhPythonScript(
    h1=Slider(10, range=0..10),
    h2=Slider(57.51, range=0..60),
    h3=Slider(2.76, range=0..10),
    r=Slider(0.49, range=0..10),
    c=pt_4)  # -> out, d; inputs c: Point3d
# ---------- box_2: Python ----------
import rhinoscriptsyntax as rs
import Rhino.Geometry as rg
import math

class Box:
    def __init__(self, h1, h2, h3, r, c):
        self.h1 = h1 # float
        self.h2 = h2 # float
        self.h3 = h3 # float
        self.r = r # float
        self.c = c # rg.Point3d
        
    def get_distance(self, p):
        x, y, z = p.X, p.Y, p.Z
        dx = abs(x-self.c.X)-(self.h1/2.0-self.r)
        dy = abs(y-self.c.Y)-(self.h2/2.0-self.r)
        dz = abs(z-self.c.Z)-(self.h3/2.0-self.r)
        inside = max([dx,dy,dz])-self.r
        dx = max(dx,0)
        dy = max(dy,0)
        dz = max(dz,0)
        if inside+self.r>0:
            #rounded corner case
            return math.sqrt(dx**2 + dy**2 + dz**2) - self.r 
        else:
            return inside
        
d = Box(h1, h2, h3, r, c)

d.get_distance(rg.Point3d(0,0,0))
# ---------- end box_2 ----------

# ----
union = GhPythonScript(d1=sphere.d, d2=box_2.d)  # -> out, d
# ---------- union: Python ----------
class Union:
    def __init__(self, d1, d2):
        self.d1 = d1 # some class that has a get_distance method
        self.d2 = d2 # some class that has a get_distance method
        
    def get_distance(self, p):
        distance1 = d1.get_distance(p)
        distance2 = d2.get_distance(p)
        return min(distance1, distance2) 
        
        
d = Union(d1, d2)
# ---------- end union ----------

# ---- group: Smooth Union
sunion = GhPythonScript(d1=sphere.d, d2=box_2.d, r=Slider(20.94, range=0..30))  # -> out, d
# ---------- sunion: Python ----------
class SUnion:
    def __init__(self, d1, d2, f):
        self.d1 = d1 # some class that has a get_distance method
        self.d2 = d2 # some class that has a get_distance method
        self.r = r   # float
        
    def get_distance(self, p):
        distance1 = d1.get_distance(p)
        distance2 = d2.get_distance(p)
        e = max(self.r - abs(distance1-distance2), 0)
        return min(distance1,distance2) - e*e*0.25/self.r
        
d = SUnion(d1, d2, r)

import Rhino.Geometry as rg
print(d.get_distance(rg.Point3d(0,0,0)))
# ---------- end sunion ----------

# ---- group: Subtraction
neg = Negative(Value=subtraction_2)
max = Maximum(A=subtraction, B=neg)

# ---- group: Union
min = Minimum(A=subtraction, B=subtraction_2)

# ---- group: Intersection
max_2 = Maximum(A=subtraction, B=subtraction_2)

# ----
python = GhPythonScript(d=sunion.d, pts=pt_2)  # -> out, distances; inputs pts: list of Point3d
# ---------- python: Python ----------
import rhinoscriptsyntax as rs

distances = []

for p in pts:
    distances.append(d.get_distance(p))
# ---------- end python ----------

# ---- group: Union
min_2 = Minimum(A=min, B=subtraction_3)

# ----
distance = Data(min)
distance_2 = Data(flatten(python.distances))

# ---- group: Offsetting
addition = Addition(A=distance, B=Slider(0.24, range=-20..20))

# ---- group: Many offsets
mod = Modulus(A=distance, B=Slider(7, range=0..10))

# ---- group: Visualization
number_slider_6 = Slider(36, range=0..100)
bnd = Bounds(Numbers=flatten(distance_2))
dedomain = DeconstructDomain(Domain=bnd)  # -> Start, End
gradient = Gradient(
    LowerLimit=Slider(0, range=0..100),
    UpperLimit=dedomain.End,
    Parameter=distance_2,
    stops=[0: RGB(0, 128, 0), 0.121: RGB(255, 255, 0), 1: RGB(255, 0, 0)])
cloud = CloudDisplay(Points=pt_2, Colours=gradient, Size=Slider(1.24, range=0..10), SpriteType=1)

# ----
distance_3 = Data(mod)

# ---- group: Points inside the shape
larger = LargerThan(FirstNumber=distance, SecondNumber="0")  # -> LargerThan, OrEqualTo
dispatch = Dispatch(List=query_point, DispatchPattern=larger.LargerThan)  # -> ListA, ListB
pt_5 = Point(dispatch.ListB)

# ---- group: Visualization
number_slider_7 = Slider(36, range=0..100)
bnd_2 = Bounds(Numbers=flatten(distance_3))
dedomain_2 = DeconstructDomain(Domain=bnd_2)  # -> Start, End
gradient_2 = Gradient(
    LowerLimit=Slider(0, range=0..100),
    UpperLimit=dedomain_2.End,
    Parameter=distance_3,
    stops=[0: RGB(0, 128, 0), 0.489: RGB(255, 255, 0), 1: RGB(255, 0, 0)])
cloud_2 = CloudDisplay(Points=query_point, Colours=gradient_2, Size=Slider(1.24, range=0..10), SpriteType=1)
