# Grasshopper definition example_1.gh (Grasshopper 1.0.7)
# plug-ins: Axolotl Info

# ---- group: CSG
# Primitives
X = UnitX(Factor=1)
Y = UnitY(Factor=1)
Z = UnitZ(Factor=1)
number_slider = Slider(9, range=0..10)
pl = PlaneNormal(Origin=Point(0, 0, 0), ZAxis=[X, Y, Z])
box = Box(DimensionX=number_slider, DimensionY=number_slider, DimensionZ=number_slider, Radius=0, Plane=PlaneXY(0, 0, 0))
sphere = Sphere(Radius=Slider(6, range=0..10), Center=Point(0, 0, 0))
cylinder = Cylinder(Radius=Slider(3, range=0..10), Height=Slider(12, range=0..20), Plane=pl, Fillet=0)

# ----
# Random Planes for Edges
number_slider_2 = Slider(3.4, range=0..10)  # disabled
number_slider_3 = Slider(9, range=0..10)  # disabled
sph = Sphere(Base=PlaneXY(0, 0, 0), Radius=number_slider_2)  # disabled
popgeo = PopulateGeometry(Geometry=sph, Count=number_slider_3, Seed=1)  # disabled
pl_2 = PlaneNormal(Origin=popgeo, ZAxis=popgeo)  # disabled

# ----
# Bounding Box
number_slider_4 = Slider(10, range=0..10)  # disabled
neg = Negative(Value=number_slider_4)  # disabled
dom = ConstructDomain(DomainStart=neg, DomainEnd=number_slider_4)  # disabled
box_2 = DomainBox(Base=PlaneXY(0, 0, 0), X=dom, Y=dom, Z=dom)  # disabled
edges = BrepEdges(Brep=box_2)  # -> Naked, Interior, NonManifold; disabled

# ----
# Outer Shape
number_slider_5 = Slider(25, range=0..100)  # disabled
sph_2 = Sphere(Base=PlaneXY(0, 0, 0), Radius=1)  # disabled
popgeo_2 = PopulateGeometry(Geometry=sph_2, Count=number_slider_5, Seed=1)  # disabled
number_slider_6 = Slider(6, range=0..10)  # disabled
number_slider_7 = Slider(0.2, range=0..1)  # disabled
plane = Plane(Normal=popgeo_2, Distance=number_slider_6)  # disabled
number_slider_8 = Slider(150, range=0..300)  # disabled
boolean_intersect = BooleanIntersect(DistanceObjectS=plane)  # disabled
shell = Shell(DistanceObject=boolean_intersect, Thickness=number_slider_7, Factor=0)  # disabled
isosurface_distancefunction = IsosurfaceDistancefunction(
    BoundingBox=box_2,
    NumberX=number_slider_8,
    NumberY=number_slider_8,
    NumberZ=number_slider_8,
    Isovalue=0,
    Capped=False,
    DistanceObject=shell,
    Refine=True)  # disabled
swatch = ColourSwatch(SwatchColor=RGBA(255, 255, 255, 10))  # disabled
preview = CustomPreview(Geometry=isosurface_distancefunction, Material=swatch)  # disabled

# ---- group: CSG
# Boolean Operators
boolean_intersect_2 = BooleanIntersect(DistanceObjectS=sphere, DistanceObject=box)
boolean_union = BooleanUnion(DistanceObjectS=cylinder)
boolean_subtract = BooleanSubtract(DistanceObject=boolean_intersect_2, DistanceObject_2=boolean_union)

# ----
# Square edge profiles
# Blended smoothly with a central sphere
dimension_x_y = Slider(1.5, range=0..10)  # disabled
number_slider_9 = Slider(3.5, range=0..10)  # disabled
number_slider_10 = Slider(0.3, range=0..1)  # disabled
number_slider_11 = Slider(2, range=0..10)  # disabled
number_slider_12 = Slider(6, range=0..10)  # disabled
box_3 = Box(DimensionX=dimension_x_y, DimensionY=dimension_x_y, DimensionZ=number_slider_9, Radius=number_slider_10, Plane=pl_2)  # disabled
boolean_union_2 = BooleanUnion(DistanceObjectS=box_3)  # disabled
sphere_2 = Sphere(Radius=number_slider_11, Center=Point(0, 0, 0))  # disabled
smoothunionlist = SmoothUnionList(DistanceObjects=flatten([boolean_union_2, sphere_2]), SmoothingFactor=number_slider_12)  # disabled

# ----
# Octree Meshing
number_slider_13 = Slider(7, range=0..10)
isosurface_octree = IsosurfaceOctree(Origin=Point(0, 0, 0), WorldSize=10, Isovalue=0, Subdivisions=number_slider_13, DistanceObject=boolean_subtract)
preview_2 = CustomPreview(Geometry=isosurface_octree, Material=ColourSwatch(SwatchColor=RGB(238, 102, 121)))

# ----
# Slice 2D
number_slider_14 = Slider(-5, range=-5..5)
pt = ConstructPoint(XCoordinate=0, YCoordinate=0, ZCoordinate=number_slider_14)
xy = XYPlane(Origin=pt)
slice2d = Slice2D(DistanceObject=boolean_subtract, NumberU=50, NumberV=50, DimensionX=10, DimensionY=10, Plane=xy)  # -> Values, Mesh, Contours

# ----
# Inner Lattices
number_slider_15 = Slider(0.2, range=0..1)  # disabled
number_slider_16 = Slider(1, range=0..10)  # disabled
number_slider_17 = Slider(250, range=0..300)  # disabled
lattice = Lattice(Cellsize=number_slider_16, Thickness=number_slider_15)  # disabled
boolean_intersect_3 = BooleanIntersect(DistanceObjectS=boolean_intersect, DistanceObject=lattice)  # disabled
isosurface_distancefunction_2 = IsosurfaceDistancefunction(
    BoundingBox=box_2,
    NumberX=number_slider_17,
    NumberY=number_slider_17,
    NumberZ=number_slider_17,
    Isovalue=0,
    Capped=False,
    DistanceObject=boolean_intersect_3,
    Refine=True)  # disabled
swatch_2 = ColourSwatch(SwatchColor=RGB(238, 102, 121))  # disabled
preview_3 = CustomPreview(Geometry=isosurface_distancefunction_2, Material=swatch_2)  # disabled

# ----
# Create shell and cut off tips
number_slider_18 = Slider(0.2, range=0..1)  # disabled
number_slider_19 = Slider(4.8, range=0..10)  # disabled
number_slider_20 = Slider(1, range=0..2)  # disabled
shell_2 = Shell(DistanceObject=smoothunionlist, Thickness=number_slider_18, Factor=number_slider_20)  # disabled
sphere_3 = Sphere(Radius=number_slider_19, Center=Point(0, 0, 0))  # disabled
boolean_intersect_4 = BooleanIntersect(DistanceObjectS=sphere_3, DistanceObject=shell_2)  # disabled

# ----
# Isosurface Meshing
number_slider_21 = Slider(200, range=0..200)  # disabled
isosurface_distancefunction_3 = IsosurfaceDistancefunction(
    NumberX=number_slider_21,
    NumberY=number_slider_21,
    NumberZ=number_slider_21,
    Isovalue=0,
    Capped=False,
    DistanceObject=boolean_intersect_4,
    Refine=True)  # disabled
swatch_3 = ColourSwatch(SwatchColor=RGB(238, 102, 121))  # disabled
preview_4 = CustomPreview(Geometry=isosurface_distancefunction_3, Material=swatch_3)  # disabled
