# Grasshopper definition example_2.gh (Grasshopper 1.0.7)
# plug-ins: Axolotl Info

# ----
# Brick
number_slider = Slider(280, range=0..1000)  # disabled
number_slider_2 = Slider(80, range=0..1000)  # disabled
domension_z = Slider(160, range=0..1000)  # disabled
number_slider_3 = Slider(100, range=0..100)  # disabled
multiplication = Multiplication(A=number_slider_3, B=-1)  # disabled
division = Division(A=domension_z, B=2)  # disabled
multiplication_2 = Multiplication(A=division, B=-1)  # disabled
number_slider_4 = Slider(25, range=0..100)  # disabled
number_slider_5 = Slider(30, range=0..100)  # disabled
box = Box(DimensionX=number_slider, DimensionY=number_slider_2, DimensionZ=domension_z, Radius=0, Plane=PlaneXY(0, 0, 0))  # disabled
pt = ConstructPoint(XCoordinate=[number_slider_3, multiplication], YCoordinate=0, ZCoordinate=division)  # disabled
pt_2 = ConstructPoint(XCoordinate=[number_slider_3, multiplication], YCoordinate=0, ZCoordinate=multiplication_2)  # disabled
cylinder = Cylinder(Radius=number_slider_4, Height=number_slider_5, Plane=pt, Fillet=0)  # disabled
cylinder_2 = Cylinder(Radius=number_slider_4, Height=number_slider_5, Plane=pt_2, Fillet=0)  # disabled
boolean_union = BooleanUnion(DistanceObjectS=cylinder, DistanceObject=box)  # disabled
boolean_union_2 = BooleanUnion(DistanceObjectS=cylinder_2)  # disabled
boolean_subtract = BooleanSubtract(DistanceObject=boolean_union, DistanceObject_2=boolean_union_2)  # disabled
number_slider_6 = Slider(250, range=0..1000)  # disabled
number_slider_7 = Slider(120, range=0..1000)  # disabled
number_slider_8 = Slider(81, range=0..1000)  # disabled
box_2 = Box(DimensionX=number_slider_6, DimensionY=number_slider_8, DimensionZ=number_slider_7, Radius=0, Plane=PlaneXY(0, 0, 0))  # disabled
boolean_subtract_2 = BooleanSubtract(DistanceObject=boolean_subtract, DistanceObject_2=box_2)  # disabled

# ----
# Brick Wall
number_slider_9 = Slider(5, range=0..10)
neg = Negative(Value=number_slider_9)
dom = ConstructDomain(DomainStart=neg, DomainEnd=number_slider_9)
xz = XZPlane(Origin=Point(0, 0, 0))
multiplication_3 = Multiplication(A=number_slider_9, B="2")
rectangle = Rectangle(Plane=xz, XSize=dom, YSize=dom, Radius=0)  # -> Rectangle, Length
morter = Slider(0.2, range=0..2)
pt_3 = ConstructPoint(XCoordinate=0, YCoordinate=0, ZCoordinate=0)
thickness = Slider(1.2, range=0..5)
arrrec = RectangularArray(Geometry=pt_3, Cell=rectangle.Rectangle, XCount=Slider(8, range=0..10), YCount=Slider(5, range=0..10))  # -> Geometry, Transform
subtraction = Subtraction(A=multiplication_3, B=morter)
xz_2 = XZPlane(Origin=arrrec.Geometry)
subtraction_2 = Subtraction(A=subtraction, B=thickness)
box_3 = Box(DimensionX=subtraction_2, DimensionY=subtraction_2, DimensionZ=subtraction, Radius=0, Plane=xz_2)
box_4 = Box(DimensionX=subtraction, DimensionY=subtraction, DimensionZ=subtraction, Radius=0, Plane=xz_2)

# ----
# Matrice
number_slider_10 = Slider(20, range=0..100)  # disabled
number_slider_11 = Slider(10, range=0..10)  # disabled
number_slider_12 = Slider(15, range=0..100)  # disabled
recgrid = Rectangular(
    Plane=PlaneXY(0, 0, 0),
    SizeX=number_slider_11,
    SizeY=number_slider_11,
    ExtentX=number_slider_10,
    ExtentY=number_slider_12)  # -> Cells, flatten(Points); disabled
pdecon = Deconstruct(Point=recgrid.Points)  # -> XComponent, YComponent, ZComponent; disabled

# ----
# Lattices generator
# To have XY values
# between 0 and 1
# To have XY values
# between 0 and 1
expression = Expression(x=pdecon.XComponent, y=pdecon.YComponent, nx=number_slider_10, ny=number_slider_12, Expression="{x/(nx*10), y/(ny*10)}")  # disabled
image = ImageSampler(expression, Filter="Value", Interpolate=False, Umax=1, Umin=0, Vmax=1, Vmin=0, Wrap=1)  # disabled
number_slider_13 = Slider(3.2, range=0..10)  # disabled
expression_2 = Expression(x=image, y=number_slider_13, Expression="x+((1.0-x)*y)")  # disabled
number_slider_14 = Slider(5, range=0..10)  # disabled
lattice = Lattice(Cellsize=number_slider_14, Thickness=expression_2)  # -> graft(DistanceObject); disabled

# ----
# Bricks
number_slider_15 = Slider(0.1, range=-0.5..0.5)  # disabled
num = Number(number_slider_11)  # disabled
subtraction_3 = Subtraction(A=num, B=number_slider_15)  # disabled
box_5 = Box(DimensionX=subtraction_3, DimensionY=subtraction_3, DimensionZ=subtraction_3, Radius=0, Plane=recgrid.Points)  # -> graft(DistanceObject); disabled

# ----
# Inner Lattices
number_slider_16 = Slider(25, range=0..100)  # disabled
number_slider_17 = Slider(0.5, range=0..1)  # disabled
tpms = TPMS(Wavelength=number_slider_16)  # disabled
add = Add(DistanceObject=tpms, Addend=number_slider_17)  # disabled

# ----
# Inner Lattices
number_slider_18 = Slider(0.35, range=0..1)
tpms_2 = TPMS(Wavelength=Slider(13, range=0..100))
shell = Shell(DistanceObject=tpms_2, Thickness=number_slider_18, Factor=0.5)
boolean_intersect = BooleanIntersect(DistanceObjectS=graft(box_3), DistanceObject=shell)

# ----
# Bounding Box
panel = Panel("2")  # disabled
division_2 = Division(A=num, B=panel)  # disabled
box_6 = CenterBox(Base=recgrid.Points, X=division_2, Y=division_2, Z=division_2)  # disabled

# ----
# Bounding Box
number_slider_19 = Slider(150, range=0..1000)  # disabled
number_slider_20 = Slider(50, range=0..100)  # disabled
number_slider_21 = Slider(100, range=0..100)  # disabled
box_7 = CenterBox(Base=PlaneXY(0, 0, 0), X=number_slider_19, Y=number_slider_20, Z=number_slider_21)  # disabled

boolean_intersect_2 = BooleanIntersect(DistanceObjectS=box_2, DistanceObject=add)  # disabled
boolean_union_3 = BooleanUnion(DistanceObjectS=boolean_subtract_2, DistanceObject=boolean_intersect_2)  # disabled

boolean_subtract_3 = BooleanSubtract(DistanceObject=box_4, DistanceObject_2=box_3)
boolean_union_4 = BooleanUnion(DistanceObjectS=graft(boolean_subtract_3), DistanceObject=boolean_intersect)  # -> flatten(D)

# ----
# Bounding Box
panel_2 = Panel("5")
box_8 = CenterBox(Base=arrrec.Geometry, X=panel_2, Y=panel_2, Z=panel_2)

boolean_intersect_3 = BooleanIntersect(DistanceObjectS=box_5, DistanceObject=lattice)  # -> flatten(DistanceObject); disabled

# ----
# Isosurface Meshing
number_slider_22 = Slider(3, range=0..10)  # disabled
voxel_size = VoxelSize(BoundingBox=box_7, UnitCell=number_slider_22)  # -> NumberX, NumberY, NumberZ; disabled
isosurface_distancefunction = IsosurfaceDistancefunction(
    BoundingBox=box_7,
    NumberX=voxel_size.NumberX,
    NumberY=voxel_size.NumberY,
    NumberZ=voxel_size.NumberZ,
    Isovalue=0,
    Capped=False,
    DistanceObject=boolean_union_3,
    Refine=True)  # disabled
swatch = ColourSwatch(SwatchColor=RGB(238, 102, 121))  # disabled
preview = CustomPreview(Geometry=isosurface_distancefunction, Material=swatch)  # disabled

# ----
# Isosurface Meshing
number_slider_23 = Slider(30, range=0..100)  # disabled
isosurface_distancefunction_2 = IsosurfaceDistancefunction(
    BoundingBox=box_6,
    NumberX=number_slider_23,
    NumberY=number_slider_23,
    NumberZ=number_slider_23,
    Isovalue=0,
    Capped=False,
    DistanceObject=boolean_intersect_3,
    Refine=True)  # disabled
swatch_2 = ColourSwatch(SwatchColor=RGB(238, 102, 121))  # disabled
preview_2 = CustomPreview(Geometry=isosurface_distancefunction_2, Material=swatch_2)  # disabled

# ----
# Isosurface Meshing
number_slider_24 = Slider(45, range=0..100)
isosurface_distancefunction_3 = IsosurfaceDistancefunction(
    BoundingBox=box_8,
    NumberX=number_slider_24,
    NumberY=number_slider_24,
    NumberZ=number_slider_24,
    Isovalue=0,
    Capped=False,
    DistanceObject=boolean_union_4,
    Refine=True)
preview_3 = CustomPreview(Geometry=isosurface_distancefunction_3, Material=ColourSwatch(SwatchColor=RGB(238, 102, 121)))
