# Grasshopper definition week1_optimized_gh_04_testing_new_dynamics.gh (Grasshopper 1.0.7)

zcount = Slider(10, range=0..100)
xcount = Slider(20, range=1..100)
ycount = Slider(15, range=1..100)
geo = Geometry([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])
# option 5
bricks = GhPythonScript(robot_base_geometry=geo, xcount=xcount, ycount=ycount, zcount=zcount)  # -> surfaces, robot_crv, transformed_robot_base, meshes, normal_planes, base_planes; inputs robot_base_geometry: list of Brep, xcount: Int32, ycount: Int32, zcount: Int32
# ---------- bricks: Python ----------
from compas_rhino import unload_modules
unload_modules('model')
        
from model import Wall
from model import Fabrication
import random as r
import Rhino.Geometry as rg
import math
import rhinoscriptsyntax as rs
        
from model import Brick
        
blength= Brick.REFERENCE_LENGTH
bheight=Brick.REFERENCE_HEIGHT
bwidth=Brick.REFERENCE_WIDTH
        
planes=[]
meshes=[]
base_planes=[]

circle_pts=[]
bricks=[]


a=[]
b=[]

        
        
def circle_pt(n, rad):
          
    """
    CREATING CIRCLE POINTS TO USE THEIR VALUES FOR OUR BRICKS
    N=RESOLUTION
    RAD=RADIUS
    """
        
    for i in range(n):
        theta=math.radians(360)*i/n
        a.append (math.sin(theta)*rad ) 
        b.append (math.cos(theta)*rad) 
                
        point_big_circ=rg.Point3d(a[i],b[i],0)
        circle_pts.append(point_big_circ)
    circle_pts.append(rg.Point3d(a[0],b[0],0))
    return a
    return b


        
circle_pt(55, 180)
        

list.reverse(a)
list.reverse(b)

btemp = b
[-x for x in btemp]

b=b+btemp+b+btemp

atemp=a
[-x for x in atemp]

a= a+ atemp + a + atemp


#COMBINING WITH Y VARIATIONS##

def opt5():    
        
    """
    ***Default Values***
    xpos= blength* j + 15* i + a[i]* j *0 .01
    ypos= bwidth* k + b[i]*k*0.1
    zpos= bheight* i
            
    """

    ##########SETTING THE FIRST LEVEL BASE############
    xposlist=[]
    yposlist=[]
    zposlist=[]
    

    for k in range (ycount):
        for j in range (k*2, (xcount)*2 -k*2):
            #B[J] = DISTANCES OF CIRCLE POINTS IN X AXIS, GRADUAL DISTANCE
            #PUTTING BIGGER DISTANCE FOR THE BRICKS ON THE LEFT
            
            yvalue=bwidth*k*3 + b[j]*2 +a[j]* 1.5 -20

            if j<20:
            
                xpos=bwidth*j*0.55- b[j]*1
                ypos=yvalue
                
            else:
                xpos=bwidth*j*2.5 -b[j]*0.3 -a[j]*0.1- blength*15
                ypos=yvalue
                        
                
            xposlist.append(xpos)
            yposlist.append(ypos)


                            
            #GRADUAL ROTATION FOR EACH BRICK
            angle= b[j] + 110
            rotation=math.radians(angle)
                    

            #TRANSLATING TO PLANE
            plane_origin=rg.Point3d(xpos, ypos, 0)
            
            plane=rg.Plane(plane_origin, rg.Vector3d.XAxis, rg.Vector3d.YAxis)
            plane.Rotate(rotation, rg.Vector3d.ZAxis)
                    
            MyBrick = Brick(plane)
            planes.append(MyBrick.picking_plane())
            
            #BASE PLANES = THE LIST WE USE FOR FABRICATION#
            base_planes.append(MyBrick.base_plane())
            
            meshes.append(MyBrick.mesh())
            bricks.append(Brick(plane))
                      
                      
                      
    ycloser= 0.1  #value for reducing the y distance  in each Z loop

    ##########SETTING THE NEXT LEVELS USING XPOSLIST, YPOSTLIST######
    for i in range (zcount):
                
            
        for k in range(0, ycount):
            for j in range( k*2 +i , (xcount)*2 -k*2-i ) :
                yvalue=bwidth*k*3 + b[j]*2 +a[j]* 1.5 -20
                
                if i%2==0:
                    xpos= xposlist[j] + j*0.5
                    angle= b[j]*0.5+ 80 + k*4
                    ypos= yvalue
                    
                else:
                    xpos= xposlist[j] + 10 -j
                    angle= 11.6*j +k*10
                    ypos=yvalue
                    if j>13 and k>1:
                        ypos=ypos+5
                        xpos=xpos+1
                        
                        
                zpos= bheight*i + bheight 
                
                rotation=math.radians(angle)
                        
                ##TRANSLATING TO PLANE##
                plane_origin=rg.Point3d(xpos, ypos , zpos)
                plane=rg.Plane(plane_origin, rg.Vector3d.XAxis, rg.Vector3d.YAxis)
                plane.Rotate(rotation, rg.Vector3d.ZAxis)
                        
                MyBrick = Brick(plane)
                planes.append(MyBrick.picking_plane())
                base_planes.append(MyBrick.base_plane())
                meshes.append(MyBrick.mesh())
                
                
                bricks.append(Brick(plane))
        if i<2:
            ycloser += 0.3
        else:
            ycloser -= 00

opt5()
# ---------- end bricks ----------
plane = Plane(bricks.normal_planes)
geo_2 = Geometry(bricks.surfaces)
geometry = Geometry(bricks.meshes)

zcount_2 = Slider(10, range=0..100)
xcount_2 = Slider(20, range=1..100)
ycount_2 = Slider(15, range=1..100)
# option 4
bricks_2 = GhPythonScript(robot_base_geometry=geo, xcount=xcount_2, ycount=ycount_2, zcount=zcount_2)  # -> surfaces, robot_crv, transformed_robot_base, meshes, normal_planes, base_planes; inputs robot_base_geometry: list of Brep, xcount: Int32, ycount: Int32, zcount: Int32; disabled
# ---------- bricks_2: Python ----------
from compas_rhino import unload_modules
unload_modules('model')
        
from model import Wall
from model import Fabrication
import random as r
import Rhino.Geometry as rg
import math
import rhinoscriptsyntax as rs
        
from model import Brick
        
blength= Brick.REFERENCE_LENGTH
bheight=Brick.REFERENCE_HEIGHT
bwidth=Brick.REFERENCE_WIDTH
        
planes=[]
meshes=[]
base_planes=[]

circle_pts=[]
bricks=[]


a=[]
b=[]

        
        
def circle_pt(n, rad):
            
    """
    CREATING CIRCLE POINTS TO USE THEIR VALUES FOR OUR BRICKS
    N=RESOLUTION
    RAD=RADIUS
    """
        
    for i in range(n):
        theta=math.radians(180)*i/n
        a.append (math.sin(theta)*rad ) 
        b.append (math.cos(theta)*rad) 
                
        point_big_circ=rg.Point3d(a[i],b[i],0)
        circle_pts.append(point_big_circ)
    circle_pts.append(rg.Point3d(a[0],b[0],0))
    return a
    return b


        
circle_pt(20,150)
        

list.reverse(a)
list.reverse(b)

btemp = b
[-x for x in btemp]

b=b+btemp+b+btemp

atemp=a
[-x for x in atemp]

a= a+ atemp + a + atemp


#COMBINING WITH Y VARIATIONS##

def opt4():    
        
    """
    ***Default Values***
    xpos= blength* j + 15* i + a[i]* j *0 .01
    ypos= bwidth* k + b[i]*k*0.1
    zpos= bheight* i
            
    """

    ##########SETTING THE FIRST LEVEL BASE############
    xposlist=[]
    yposlist=[]
    zposlist=[]
    
    
    for k in range (ycount):

        for j in range (k, xcount-k):
                    
            #B[J] = DISTANCES OF CIRCLE POINTS IN X AXIS, GRADUAL DISTANCE
            #PUTTING BIGGER DISTANCE FOR THE BRICKS ON THE LEFT
            
            

            xpos=blength*j*1.9 -b[j]*1.1 -bwidth*1.8
            ypos=bwidth*k*3.3 + b[j]*1.9 +a[j]
                        
                
            xposlist.append(xpos)
            yposlist.append(ypos)


                            
            #GRADUAL ROTATION FOR EACH BRICK
            angle= b[j]*.5 + 110
            rotation=math.radians(angle)
                    

            #TRANSLATING TO PLANE
            plane_origin=rg.Point3d(xpos, ypos , 0)
            plane=rg.Plane(plane_origin, rg.Vector3d.XAxis, rg.Vector3d.YAxis)
            plane.Rotate(rotation, rg.Vector3d.ZAxis)
                    
            MyBrick = Brick(plane)
            planes.append(MyBrick.picking_plane())
            
            #BASE PLANES = THE LIST WE USE FOR FABRICATION#
            base_planes.append(MyBrick.base_plane())
            
            meshes.append(MyBrick.mesh())
            bricks.append(Brick(plane))
                  
                  
                  
    ycloser= 0.1  #value for reducing the y distance  in each Z loop

    ##########SETTING THE NEXT LEVELS USING XPOSLIST, YPOSTLIST######
    for i in range (zcount):
                
            
        for k in range(0, ycount):
            for j in range( k+i , xcount -i-int(k/2)) :
                
                if i%2==0:
                    xpos= xposlist[j] 
                    angle= b[j]*0.5+ 80 + k*4
                    ypos= bwidth*k*(3.3-ycloser) + b[j]*1.9 +a[j] 

                    
                else:
                    xpos= xposlist[j] + 10 -j
                    angle= 11.6*j +k*10
                    ypos= bwidth*k*(3.3-ycloser) + b[j]*1.9 +a[j] +5
                    if j>13 and k>1:
                        ypos=ypos+5
                        xpos=xpos+1
                        
                        
                zpos= bheight*i + bheight 
                
                rotation=math.radians(angle)
                        
                ##TRANSLATING TO PLANE##
                plane_origin=rg.Point3d(xpos, ypos , zpos)
                plane=rg.Plane(plane_origin, rg.Vector3d.XAxis, rg.Vector3d.YAxis)
                plane.Rotate(rotation, rg.Vector3d.ZAxis)
                        
                MyBrick = Brick(plane)
                planes.append(MyBrick.picking_plane())
                base_planes.append(MyBrick.base_plane())
                meshes.append(MyBrick.mesh())
                
                
                bricks.append(Brick(plane))
        if i<2:
            ycloser += 0.3
        else:
            ycloser -= 00

opt4()

team_planes=planes
# ---------- end bricks_2 ----------
geometry_2 = Geometry(bricks_2.meshes)

custom_preview = CustomPreview(Geometry=geometry, Material=ColourSwatch(SwatchColor=RGBA(255, 199, 199, 74)))

list_length = ListLength(List=geometry)
panel = Panel(list_length)

number_slider = Slider(370, range=0..1000)  # disabled
number_slider_2 = Slider(1, range=0..100)  # disabled
number_slider_3 = Slider(-70, range=-200..1000)  # disabled
vector_xyz = VectorXYZ(XComponent=number_slider, YComponent=number_slider_3, ZComponent=number_slider_2)  # -> Vector, Length; disabled

plane_2 = Plane(bricks.base_planes)  # disabled

number_slider_4 = Slider(284, range=0..1000)  # disabled
rotate = Rotate(Geometry=plane_2, Angle=number_slider_4, Plane=PlaneXY(0, 0, 0))  # -> Geometry, Transform; disabled

move = Move(Geometry=rotate.Geometry, Motion=vector_xyz.Vector)  # -> Geometry, Transform; disabled

geo_3 = Geometry([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])
bricks_3 = GhPythonScript()  # -> out, bricks; disabled
# ---------- bricks_3: Python ----------
from compas_rhino import unload_modules
unload_modules('model')

import Rhino.Geometry as rg

from model import Brick

import math as m




bricks = []


for i in range(10):  # layer count
    for j in range(10):  # layer length

        if i % 2 == 0:
            x_pos = j * (Brick.REFERENCE_LENGTH+1)
            rotation = m.radians(10)
        else:
            x_pos = j * (Brick.REFERENCE_LENGTH+1) + (Brick.REFERENCE_LENGTH/2)-1
            rotation = m.radians(-10)

        z_pos = i * (Brick.REFERENCE_HEIGHT)

        origin = rg.Point3d(x_pos, 0, z_pos)
        plane = rg.Plane(origin, rg.Vector3d.XAxis, rg.Vector3d.YAxis)
        plane.Rotate(rotation, rg.Vector3d.ZAxis)
        bricks.append(Brick(plane))
# ---------- end bricks_3 ----------
visualization = GhPythonScript(robot_base=geo_3)  # -> out, geo, transformed_robot_base, v_w_p, s_crv; inputs bricks: list, robot_base: list of Brep
# ---------- visualization: Python ----------
"""Generates a 3D model of the wall

Returns
----------
geo : [Rhino Geometry Surface, Rhino Geometry Surface, ...]

"""
from compas_rhino import unload_modules
unload_modules('model')

import Rhino.Geometry as rg

from model import Fabrication
from model import Brick

planes = []
geo = []

for brick in bricks:
    geo.append(brick.mesh())

visualizeFabrication = Fabrication(brick_planes=planes)
visualizeFabrication.procedure(transform=False)


# return 
robot_matrix = visualizeFabrication.robot_transformation()
transformed_robot_base = []
for brep in robot_base:
    trans_brep = brep.Duplicate()
    trans_brep.Transform(robot_matrix)
    transformed_robot_base.append(trans_brep)
# ---------- end visualization ----------
fabrication = GhPythonScript(send=Toggle(False))  # -> out, rhino_base_way_planes, robot_planes, robot_plane; inputs bricks: list, base_planes: list of Plane, send: Boolean; disabled
# ---------- fabrication: Python ----------
import Rhino.Geometry as rg
import simple_comm as c
import simple_ur_script as ur
from model import Brick
import math as m

geo = []
rhino_base_way_planes = []

rhino_base_way_planes= base_planes[144:216]

#for brick in bricks:
#    rhino_base_way_planes.append(brick.base_plane())
#    
#    ## here you can use any list with plane list of the design##


def tcp(script):
    """ This funktion sets tcp 
    """
    script += ur.set_tcp_by_angles(
        0.0, 0.0, 74.0, m.radians(0.0), m.radians(180.0), m.radians(0))
    return script

def set_robot_base_plane_from_pts():

    """
    original values
        pt_0 = rg.Point3d(299, 63, 20)  # base plane origin
        # point on base plane positive x direction
        pt_1 = rg.Point3d(499, 63, 20)
        pt_2 = rg.Point3d(499, 299, 20)  # point on base plane positive xy
    """

    pt_0 = rg.Point3d(299, 63, 0)  # base plane origin
    # point on base plane positive x direction
    pt_1 = rg.Point3d(499, 63, 0)
    pt_2 = rg.Point3d(499, 299, 0)  # point on base plane positive xy
    
    
    
    robot_base = rg.Plane(pt_0, pt_1-pt_0, pt_2-pt_0)
    return robot_base

def rhino_to_robot_space(rhino_plane):
    """ this funktion translates planes from the rhino cordinate system to
    the robot cordinate system 
    """
    robot_plane = rhino_plane.Clone()
    _r_matrix = rg.Transform.PlaneToPlane(
        rg.Plane.WorldXY, set_robot_base_plane_from_pts())
#    print robot_plane.Origin
#    print(robot_plane.Transform(_r_matrix))
#    print robot_plane.Origin
    return robot_plane
    
    
    
def pickup_brick(pick_up_plane, script):
    """Pick up a brick procedure

    Parameters
    ----------
    pick_up_plane : rhino.geometry.plane
    
    Returns:
    Procedure for pickin up plane
    """
    accel = 0.30   # m/s2
    vel = 0.30   # m/s

    safe_distance = 50
    
    way_planes = []

    safe_plane = pick_up_plane.Clone()
    safe_plane.Translate(rg.Vector3d(0, 0, safe_distance))

    script += ur.move_l(safe_plane, accel, vel)
    way_planes.append(safe_plane)

    script += ur.move_l(pick_up_plane, accel, vel)
    way_planes.append(pick_up_plane)

    script += ur.set_digital_out(0, False)
    script += ur.sleep(0.7)

    script += ur.move_l(safe_plane, accel, vel)
    way_planes.append(safe_plane)

    return script 

def place_brick(plane, script):
    """
    this function gereates the robotic sequience for placing a brick
    Requires a plane wich describes the possition of the brick"""

    safe_distance = 50
    accel = 0.30
    vel = 0.30
    way_planes = []

    safe_plane = plane.Clone()
    safe_plane.Translate(rg.Vector3d(0, 0, safe_distance))

    script += ur.move_l(safe_plane, accel, vel)
    way_planes.append(safe_plane)

    script += ur.move_l(plane, accel, vel)
    way_planes.append(plane)

    script += ur.set_digital_out(0, True)
    script += ur.sleep(0.4)

    script += ur.move_l(safe_plane, accel, vel)
    way_planes.append(safe_plane)

    return script

""" Robotic fabrication procedure
"""
script = ""

script = tcp(script)


#
#"""pick _up plane is measured in the robot base plane
#"""
#pick_up_plane = rg.Plane(rg.Point3d(-56, 507, 2), rg.Vector3d.XAxis, rg.Vector3d.YAxis)
#
#robot_planes = []


"""We are translating all way_planes from rhino base to robot_base
"""


pick_up_planes =[]
for i in range(6):  # rows x-direction
    for j in range(12):  # rows y-direction
        x_pos = i * (Brick.REFERENCE_LENGTH)
        y_pos = j * (Brick.REFERENCE_WIDTH)
        origin = rg.Point3d(-56+x_pos, 507-y_pos, 2)
        pick_up_plane = rg.Plane(origin, rg.Vector3d.XAxis, rg.Vector3d.YAxis)
        pick_up_planes.append(pick_up_plane)
pick_up_planes.reverse()
robot_planes = []


"""We are translating all way_planes from rhino base to robot_base
"""
for rhino_plane in (rhino_base_way_planes):
    robot_planes.append(rhino_to_robot_space(rhino_plane))
for robot_plane, pick_up_plane in zip(robot_planes, pick_up_planes):
    #pick up a plane 
    script = pickup_brick(pick_up_plane, script)
    script = place_brick(robot_plane, script)
script = c.concatenate_script(script)


if send:
    c.send_script(script, "192.168.10.10")
# ---------- end fabrication ----------
grp = Group(visualization.geo)
geo_4 = Geometry(visualization.transformed_robot_base)
geo_5 = Geometry(visualization.v_w_p)
geometry_3 = Geometry(fabrication.robot_planes)
geo_6 = Geometry(visualization.s_crv)

construct_domain = ConstructDomain(DomainStart=Slider(0, range=0..1), DomainEnd=Slider(50, range=0..100))
sub_list = SubList(List=geometry_3, Domain=construct_domain, Wrap=True)  # -> List, Index
point_list = PointList(Points=sub_list.List, Size=5)
