# Grasshopper definition week1_optimized_gh_04b_ready_for_fabr_04_fin.gh (Grasshopper 1.0.7)

ycount = Slider(10, range=1..100)
zcount = Slider(10, range=0..100)
xcount = Slider(20, range=1..100)
geo = Geometry([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])
bricks = GhPythonScript(robot_base_geometry=geo, xcount=xcount, ycount=ycount, zcount=zcount)  # -> surfaces, robot_crv, transformed_robot_base, meshes, normal_planes, base_planes, base_planes_row_01, base_planes_row_02, base_planes_row_03, base_planes_row_04; inputs robot_base_geometry: list of Brep, xcount: Int32, ycount: Int32, zcount: Int32
# ---------- bricks: Python ----------
from compas_rhino import unload_modules
unload_modules('model')
        
from model import Wall
from model import Fabrication
import random as r
import Rhino.Geometry as rg
import math
import rhinoscriptsyntax as rs
        
from model import Brick
        
blength= Brick.REFERENCE_LENGTH
bheight=Brick.REFERENCE_HEIGHT
bwidth=Brick.REFERENCE_WIDTH
        
planes=[]
meshes=[]
base_planes=[]
base_planes_row_01=[]
base_planes_row_02=[]
base_planes_row_03=[]
base_planes_row_04=[]
base_planes_row_05=[]
base_planes_row_06=[]
base_planes_row_07=[]
base_planes_row_08=[]
base_planes_row_09=[]
base_planes_row_10=[]

circle_pts=[]
bricks=[]


a=[]
b=[]

        
        
def circle_pt(n, rad):
            
    """
    CREATING CIRCLE POINTS TO USE THEIR VALUES FOR OUR BRICKS
    N=RESOLUTION
    RAD=RADIUS
    """
        
    for i in range(n):
        theta=math.radians(180)*i/n
        a.append (math.sin(theta)*rad ) 
        b.append (math.cos(theta)*rad) 
                
        point_big_circ=rg.Point3d(a[i],b[i],0)
        circle_pts.append(point_big_circ)
    circle_pts.append(rg.Point3d(a[0],b[0],0))
    return a
    return b


        
circle_pt(20,100)
        

list.reverse(a)
list.reverse(b)

btemp = b
[-x for x in btemp]

b=b+btemp+b+btemp

atemp=a
[-x for x in atemp]

a= a+ atemp + a + atemp


#COMBINING WITH Y VARIATIONS##
def opt3():    

    ##########SETTING THE FIRST LEVEL BASE############
    xposlist=[]
    yposlist=[]
    zposlist=[]
    
    
    for k in range (ycount):

        for j in range (k, xcount-k):
                    
            #B[J] = DISTANCES OF CIRCLE POINTS IN X AXIS, GRADUAL DISTANCE
            #PUTTING BIGGER DISTANCE FOR THE BRICKS ON THE LEFT
            
            
            
            if j<=6:
                xpos=blength*j*1.5  -b[j]*0.9 -bwidth*1.8
                ypos=bwidth*k*2.8 + b[j]
                        
            elif j>6 and j<12:
                xpos= blength*j*1.3 - b[j]*0.9 + bwidth
                ypos=bwidth*k*3 + b[j] 
                
            else:
                xpos= blength*j*1.3 - b[j]*0.9 +bwidth
                ypos= bwidth*k*2.9 + b[j]
    
                
            xposlist.append(xpos)
            yposlist.append(ypos)


                            
            #GRADUAL ROTATION FOR EACH BRICK
            angle= (0.5*b[j] + 90 + 10*j)/2
            rotation=math.radians(angle)
                    

            #TRANSLATING TO PLANE
            plane_origin=rg.Point3d(xpos, ypos , 0)
            plane=rg.Plane(plane_origin, rg.Vector3d.XAxis, rg.Vector3d.YAxis)
            plane.Rotate(rotation, rg.Vector3d.ZAxis)
                    
            MyBrick = Brick(plane)
            planes.append(MyBrick.picking_plane())

            
            #BASE PLANES = THE LIST WE USE FOR FABRICATION#
            base_planes.append(MyBrick.base_plane())
            base_planes_row_01.append(MyBrick.base_plane())
            
            meshes.append(MyBrick.mesh())
            bricks.append(Brick(plane))
                  
                  
                  
    ycloser= 0.1  #value for reducing the y distance  in each Z loop

    ##########SETTING THE NEXT LEVELS USING XPOSLIST, YPOSTLIST######
    for i in range (zcount):
                
        if i==0:
            lessx=1
        else:
            lessx=0
        
        if i==3:
            lessy=1
        if i>3:
            lessy=1
        else:
            lessy=0
            
        for k in range(0, ycount - lessy):
            for j in range( i+k , xcount -i -k - lessx):
                
                if i%2==0:
                    xpos= xposlist[j] + a[i]*j*0.015  - b[i]*j*0.01  +15 - j*0.3
                    angle= b[j]*0.5+ 80
                    ypos= bwidth*k* (3 -ycloser) + b[j] +a[j]*0.12 

                    
                else:
                    xpos= xposlist[j] +a[i]*j*0.02 - b[i]*j*0.01 +j*0.3
                    angle= 11.6*j
                    ypos= bwidth*k*(2.9-ycloser) + b[j] +  a[j]*0.1 
                    if j>13 and k>1:
                        ypos=ypos+5
                        xpos=xpos+1
                        
                        
                """
                FIXING SPECIFIC ROWS OR INDIVIDUAL BRICKS
                """
                
                if i==0:
                    if j==8:
                        xpos=xpos+1.5 
                        ypos=ypos +8
                    if j==7:
                        ypos=ypos+2
                        angle = angle +5
                        
                        
                elif i==1:
                    if j==10 or j==11:
                        xpos= xpos + 3
                        ypos= ypos + k*1.75
                    if k==3 or k==4 or k==5 or k==6:
                        if j==12 or j==13:
                            xpos= xpos + 3.5
                            ypos = ypos +9
                    if k==4 or k==5:
                        if j==6:
                            xpos=xpos+5
                            ypos=ypos+6
                        if j==5:
                            ypos=ypos+5
                    if j==7:
                        angle=angle-10
                        ypos=ypos
                        if k==6:
                            angle=angle-15
                            ypos=ypos+13
                        elif k>2 and k<7:
                            angle=angle-2
                            ypos=ypos+5
                    if j ==8:
                        xpos=xpos+2
                    if j==9:
                        xpos=xpos+4
                        ypos=ypos+5
                    if j==10:
                        xpos=xpos+1
                    if j==11:
                        angle=angle+10
                    if j>=13 and j<=15 :
                        ypos=ypos+3
                            
                elif i==2:
                    if j==8:
                        xpos=xpos+3
                        ypos=ypos+7
                        
                    if j==9:
                        xpos=xpos+3
                        ypos=ypos+6
                        angle =angle-3
                    if j==6 or j==7:
                        ypos=ypos+4
                    if j==15 or j==16:
                        ypos=ypos+3
                        xpos=xpos-4
                    if j==14:
                        xpos=xpos-3
                    
                       
                elif i==3:
                    if j==11:
                        xpos= xpos+ 2
                        ypos= ypos+ 5
                     
                            
                            
                zpos= bheight*i + bheight 
                
                rotation=math.radians(angle)
                        
                ##TRANSLATING TO PLANE##
                plane_origin=rg.Point3d(xpos, ypos , zpos)
                plane=rg.Plane(plane_origin, rg.Vector3d.XAxis, rg.Vector3d.YAxis)
                plane.Rotate(rotation, rg.Vector3d.ZAxis)
                        
                MyBrick = Brick(plane)
                planes.append(MyBrick.picking_plane())
                base_planes.append(MyBrick.base_plane())
                
                if i==1:
                    base_planes_row_02.append(MyBrick.base_plane())
                elif i==2:
                    base_planes_row_03.append(MyBrick.base_plane())
                elif i==3:
                    base_planes_row_04.append(MyBrick.base_plane())
                elif i==4:
                    base_planes_row_05.append(MyBrick.base_plane())
                elif i==5:
                    base_planes_row_06.append(MyBrick.base_plane())
                elif i==6:
                    base_planes_row_07.append(MyBrick.base_plane())
                elif i==7:
                    base_planes_row_08.append(MyBrick.base_plane())
                elif i==8:
                    base_planes_row_09.append(MyBrick.base_plane())
                elif i==9:
                    base_planes_row_10.append(MyBrick.base_plane())
                
                
                
                meshes.append(MyBrick.mesh())
                
                
                bricks.append(Brick(plane))
        if i<3:
            ycloser += 0.1
        else:
            ycloser -= 0.1


opt3()
# ---------- end bricks ----------
plane = Plane(bricks.normal_planes)
geo_2 = Geometry(bricks.surfaces)
geometry = Geometry(bricks.meshes)

bricks_2 = GhPythonScript(robot_base_geometry=geo, xcount=xcount, ycount=ycount, zcount=zcount)  # -> surfaces, robot_crv, transformed_robot_base, meshes, normal_planes, base_planes; inputs robot_base_geometry: list of Brep, xcount: Int32, ycount: Int32, zcount: Int32; disabled
# ---------- bricks_2: Python ----------
from compas_rhino import unload_modules
unload_modules('model')
        
from model import Wall
from model import Fabrication
import random as r
import Rhino.Geometry as rg
import math
import rhinoscriptsyntax as rs
        
from model import Brick
        
blength= Brick.REFERENCE_LENGTH
bheight=Brick.REFERENCE_HEIGHT
bwidth=Brick.REFERENCE_WIDTH
        
planes=[]
meshes=[]
base_planes=[]
circle_pts=[]

bricks=[]

a=[]
a_points =[]
b_points =[]
b=[]
c=[]
        
        
def circle_pt(n, rad):
            
    """
    CREATING CIRCLE POINTS TO USE THEIR VALUES
    N=RESOLUTION
    RAD=RADIUS
    """
        
    for i in range(n):
        theta=math.radians(180)*i/n
        a.append (math.sin(theta)*rad ) 
        b.append (math.cos(theta)*rad) 
        c.append (math.cos(theta)*rad )
                
        point_big_circ=rg.Point3d(a[i],b[i],c[i])
        circle_pts.append(point_big_circ)
        a_points.append(rg.Point3d(a[i],0,0))
    circle_pts.append(rg.Point3d(a[0],b[0],c[0]))
    return a_points
    return b
        
circle_pt(20,100)
        
arev1=a
brev1=b
list.reverse(arev1)
list.reverse(brev1)
arev=arev1
brev=brev1
        
if xcount>zcount:
    numbera=int(math.ceil(xcount/len(a))/2)
    numberb= int(math.ceil(xcount/len(b))/2)
    print (numbera)
    print (numberb)
    atemp= a+arev
    btemp= b+brev
    a=atemp*5
    b= 5 * btemp
    print ("xcount is bigger")
else:
            
    number_a=math.ceil(zcount/len(a))
    number_b=math.ceil(zcount/len(b))
    print (number_a)
    print (number_b)
    atemp= a+arev
    btemp= b+brev
    a=atemp*5
    b= btemp * 5
    print ("zcount is bigger")
        

brick_list = []

#COMBINING WITH Y VARIATIONS##
def opt3():    
        
    """
    ***Default Values***
    xpos= blength* j + 15* i + a[i]* j *0 .01
    ypos= bwidth* k + b[i]*k*0.1
    zpos= bheight* i
            
    """
            
    xposlist=[]
    yposlist=[]
    zposlist=[]
            
    ##########SETTING THE FIRST LEVEL BASE############
    for k in range (ycount):
        for j in range (k, xcount -k):
                    
            #SETTING SMALLER BRICK DISTANCE FOR THE CENTRAL PART
            #B[J] = DISTANCES OF CIRCLE POINTS IN X AXIS, GRADUAL DISTANCE
                    
            if j<=6:
                xpos=blength*j*1.45  - b[j]*0.57
                ypos=bwidth*k*2.6 + b[j]*0.8
                        
            elif j>6 and j<15:
                xpos= blength*j*1.35 - b[j]*0.9 
                ypos=bwidth*k*2.6 + b[j]*0.8
                        
            elif j>=15:
                xpos = xposlist[4]*0.95 + blength*j*1.39  - b[j]*0.8 - (blength*(15-7.1))
                ypos=bwidth*k*2.6 + b[j]*0.8
                
            """
            #SPACE BETWEEN EACH Y
            ypos=bwidth*k*2.6 + b[j]*0.8 
            """
                
            xposlist.append(xpos)
            yposlist.append(ypos)
                    
            #GRADUAL ROTATION FOR EACH BRICK
            angle=10*j
            rotation=math.radians(angle)
                    
            #TRANSLATING TO PLANE
            plane_origin=rg.Point3d(xpos, ypos , 0)
            plane=rg.Plane(plane_origin, rg.Vector3d.XAxis, rg.Vector3d.YAxis)
            plane.Rotate(rotation, rg.Vector3d.ZAxis)
                    
            MyBrick = Brick(plane)
            
            planes.append(MyBrick.picking_plane())
            
            base_planes.append(MyBrick.base_plane())
            
            meshes.append(MyBrick.mesh())
            bricks.append(Brick(plane))
                  
                  
                  
        
    ##########SETTING THE NEXT LEVELS USING XPOSLIST, YPOSTLIST######
    for i in range (zcount):
                
        if i==0:
            lessx=1
        else:
            lessx=0
        
        if i==3:
            lessy=1
        if i>3:
            lessy=1
        else:
            lessy=0
            


        for k in range(ycount - lessy):
            for j in range( i+k , xcount -i -k - lessx):
                if i%2==0:
                    xpos= xposlist[j] + a[i]*j*0.01  - b[i]*j*0.01 + 15 - j*0.3
                    angle= b[j]*0.5 +80 
                    ypos= bwidth*k*2.6 +b[j]*0.83 +10 - j*0.6
                    
                else:
                    xpos= xposlist[j] +a[i]*j*0.01  - b[i]*j*0.01 +j*0.3
                    angle=10*j - b[i]* 0.1 
                    ypos= bwidth*k*2.6 +b[j]*0.8 + j*0.3
                        
                        
                zpos= bheight*i + bheight 
                
                rotation=math.radians(angle)
                        
                ##TRANSLATING TO PLANE##
                plane_origin=rg.Point3d(xpos, ypos , zpos)
                plane=rg.Plane(plane_origin, rg.Vector3d.XAxis, rg.Vector3d.YAxis)
                plane.Rotate(rotation, rg.Vector3d.ZAxis)
                        
                MyBrick = Brick(plane)
                planes.append(MyBrick.picking_plane())
                base_planes.append(MyBrick.base_plane())
                meshes.append(MyBrick.mesh())
                
                
                bricks.append(Brick(plane))
                
        brick_list.append(meshes)
        

opt3()

team_planes=planes
# ---------- end bricks_2 ----------
plane_2 = Plane(bricks.base_planes_row_01)
panel = Panel(plane_2)

custom_preview = CustomPreview(Geometry=geometry, Material=ColourSwatch(SwatchColor=RGBA(255, 199, 199, 157)))

list_length = ListLength(List=geometry)
panel_2 = Panel(list_length)

vector_xyz = VectorXYZ(XComponent=Slider(370, range=0..1000), YComponent=Slider(-70, range=-200..1000), ZComponent=Slider(4, range=0..100))  # -> Vector, Length

plane_3 = Plane(bricks.base_planes)

rotate = Rotate(Geometry=plane_3, Angle=Slider(284, range=0..1000), Plane=PlaneXY(0, 0, 0))  # -> Geometry, Transform

move = Move(Geometry=rotate.Geometry, Motion=vector_xyz.Vector)  # -> Geometry, Transform

geo_3 = Geometry([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])
bricks_3 = GhPythonScript()  # -> out, bricks; disabled
# ---------- bricks_3: Python ----------
from compas_rhino import unload_modules
unload_modules('model')

import Rhino.Geometry as rg

from model import Brick

import math as m




bricks = []


for i in range(10):  # layer count
    for j in range(10):  # layer length

        if i % 2 == 0:
            x_pos = j * (Brick.REFERENCE_LENGTH+1)
            rotation = m.radians(10)
        else:
            x_pos = j * (Brick.REFERENCE_LENGTH+1) + (Brick.REFERENCE_LENGTH/2)-1
            rotation = m.radians(-10)

        z_pos = i * (Brick.REFERENCE_HEIGHT)

        origin = rg.Point3d(x_pos, 0, z_pos)
        plane = rg.Plane(origin, rg.Vector3d.XAxis, rg.Vector3d.YAxis)
        plane.Rotate(rotation, rg.Vector3d.ZAxis)
        bricks.append(Brick(plane))
# ---------- end bricks_3 ----------
visualization = GhPythonScript(robot_base=geo_3)  # -> out, geo, transformed_robot_base, v_w_p, s_crv; inputs bricks: list, robot_base: list of Brep; disabled
# ---------- visualization: Python ----------
"""Generates a 3D model of the wall

Returns
----------
geo : [Rhino Geometry Surface, Rhino Geometry Surface, ...]

"""
from compas_rhino import unload_modules
unload_modules('model')

import Rhino.Geometry as rg

from model import Fabrication
from model import Brick

planes = []
geo = []

for brick in bricks:
    geo.append(brick.mesh())

visualizeFabrication = Fabrication(brick_planes=planes)
visualizeFabrication.procedure(transform=False)


# return 
robot_matrix = visualizeFabrication.robot_transformation()
transformed_robot_base = []
for brep in robot_base:
    trans_brep = brep.Duplicate()
    trans_brep.Transform(robot_matrix)
    transformed_robot_base.append(trans_brep)
# ---------- end visualization ----------
fabrication = GhPythonScript(base_planes=flatten(move.Geometry), send=Toggle(True))  # -> out, rhino_base_way_planes, robot_planes, robot_plane, way_planes; inputs bricks: list, base_planes: list of Plane, send: Boolean
# ---------- fabrication: Python ----------
from compas_rhino import unload_modules
unload_modules('simple_ur_script')
import Rhino.Geometry as rg
import simple_comm as c
import simple_ur_script as ur
from model import Brick
import math as m



geo = []
rhino_base_way_planes = []

rhino_base_way_planes= base_planes[417:541]



def tcp(script):
    """ This funktion sets tcp 
    """
    script += ur.set_tcp_by_angles(
        0.0, 0.0, 74.0, m.radians(0.0), m.radians(180.0), m.radians(0))
    return script

def set_robot_base_plane_from_pts():

    """
    original values
        pt_0 = rg.Point3d(299, 63, 20)  # base plane origin
        # point on base plane positive x direction
        pt_1 = rg.Point3d(499, 63, 20)
        pt_2 = rg.Point3d(499, 299, 20)  # point on base plane positive xy
    """

    pt_0 = rg.Point3d(299, 63, 0)  # base plane origin
    # point on base plane positive x direction
    pt_1 = rg.Point3d(499, 63, 0)
    pt_2 = rg.Point3d(499, 299, 0)  # point on base plane positive xy
    
    
    
    robot_base = rg.Plane(pt_0, pt_1-pt_0, pt_2-pt_0)
    return robot_base

def rhino_to_robot_space(rhino_plane):
    """ this funktion translates planes from the rhino cordinate system to
    the robot cordinate system 
    """
    robot_plane = rhino_plane.Clone()
    _r_matrix = rg.Transform.PlaneToPlane(
     rg.Plane.WorldXY, set_robot_base_plane_from_pts())
    return robot_plane
    

def pickup_brick(pick_up_plane, script):
    """Pick up a brick procedure

    Parameters
    ----------
    pick_up_plane : rhino.geometry.plane
    
    Returns:
    Procedure for pickin up plane
    """
    accel = 0.65   # m/s2
    vel = 0.65   # m/s

    safe_distance = 50
    
    way_planes = []

    safe_plane = pick_up_plane.Clone()
    safe_plane.Translate(rg.Vector3d(0, 0, safe_distance))

    script += ur.move_l(safe_plane, accel, vel)
    way_planes.append(safe_plane)

    script += ur.move_l(pick_up_plane, accel, vel)
    way_planes.append(pick_up_plane)

    script += ur.set_digital_out(0, False)
    script += ur.sleep(0.4)

    script += ur.move_l(safe_plane, accel, vel)
    way_planes.append(safe_plane)
    return script 

def glue_brick(script):
    glue_plane = rg.Plane(rg.Point3d(-0.5,323.4,4.5),rg.Vector3d(0,0,1))
    safe_distance = 20
    accel = 0.65
    vel = 0.65
    safe_plane = glue_plane.Clone()
    safe_plane.Translate(rg.Vector3d(0, 0, safe_distance))
    script += ur.move_l(safe_plane, accel, vel)
    way_planes_glue.append(safe_plane)
    script += ur.move_l(glue_plane, accel, vel)
    way_planes_glue.append(glue_plane)
    script += ur.set_digital_out(0, False)
    script += ur.sleep(0.15)
    script += ur.move_l(safe_plane, accel, vel)
    way_planes_glue.append(safe_plane)
    
    return script

def place_brick(plane, script):
    """
    this function gereates the robotic sequience for placing a brick
    Requires a plane wich describes the possition of the brick"""

    safe_distance = 50
    accel = 0.6
    vel = 0.6
    way_planes = []

    safe_plane = plane.Clone()
    safe_plane.Translate(rg.Vector3d(0, 0, safe_distance))

    script += ur.move_l(safe_plane, accel, vel)
    way_planes.append(safe_plane)

    script += ur.move_l(plane, accel, vel)
    way_planes.append(plane)

    script += ur.set_digital_out(0, True)
    script += ur.sleep(0.4)

    script += ur.move_l(safe_plane, accel, vel)
    way_planes.append(safe_plane)
    
    

    return script

""" Robotic fabrication procedure
"""
script = ""

script = tcp(script)


#
#"""pick _up plane is measured in the robot base plane
#"""


"""We are translating all way_planes from rhino base to robot_base
"""

pick_up_planes =[]

for u in range (3): #rows-z-direction
    for i in range(6):  # rows x-direction
        for j in range(10):  # rows y-direction
            x_pos = i * (Brick.REFERENCE_LENGTH)
            y_pos = j * (Brick.REFERENCE_WIDTH)
            z_pos= u * (Brick.REFERENCE_HEIGHT)
            origin = rg.Point3d(-54.90 +x_pos, 505-y_pos, 2 + z_pos)
            pick_up_plane = rg.Plane(origin, rg.Vector3d.XAxis, rg.Vector3d.YAxis)
            pick_up_planes.append(pick_up_plane)
            
pick_up_planes.reverse()

### adding stop at glue station ###

way_planes_glue=[]


"""We are translating all way_planes from rhino base to robot_base
"""

robot_planes = []
p=0
for rhino_plane in (rhino_base_way_planes):
    robot_planes.append(rhino_to_robot_space(rhino_plane))
for robot_plane, pick_up_plane in zip( robot_planes, pick_up_planes):
    #pick up a plane
    script = pickup_brick(pick_up_plane, script)
    script = glue_brick(script) #adding glue station
    script = place_brick(robot_plane, script)
    p += 1
    script += ur.UR_log('Brick n#{} placed.'.format(p)) 
    
script = c.concatenate_script(script)

if send:
    c.send_script(script, "192.168.10.10")
# ---------- end fabrication ----------
grp = Group(visualization.geo)
geo_4 = Geometry(visualization.transformed_robot_base)
geo_5 = Geometry(visualization.v_w_p)
geo_6 = Geometry(visualization.s_crv)
geometry_2 = Geometry(fabrication.robot_planes)

construct_domain = ConstructDomain(DomainStart=Slider(0, range=0..1), DomainEnd=Slider(50, range=0..100))
sub_list = SubList(List=geometry_2, Domain=construct_domain, Wrap=True)  # -> List, Index
point_list = PointList(Points=sub_list.List, Size=5)
