# Grasshopper definition beril_guillaume.gh (Grasshopper 1.0.7)

geo = Geometry([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])
bricks = GhPythonScript(robot_base_geometry=geo)  # -> out, bricks; inputs robot_base_geometry: list of Brep
# ---------- bricks: Python ----------
from compas_rhino import unload_modules
unload_modules('model')

import Rhino.Geometry as rg
import Rhino.Collections as rc

from model import Brick
import math as m

bricks = []



for i in range (2):
    brick_origin = rg.Point3d(i*(Brick.REFERENCE_LENGTH/2 + Brick.REFERENCE_WIDTH/2), 0, 0)
    
    if i %2 == 0:
        plane = rg.Plane(brick_origin,rg.Vector3d.XAxis, rg.Vector3d.YAxis)
    
        #plane.Rotate(m.pi/2, plane.ZAxis, plane.Origin)
    
    else : 
        plane = rg.Plane(brick_origin,rg.Vector3d.XAxis, rg.Vector3d.YAxis)
        offset_vector_x = plane.XAxis
        
        plane.Rotate(m.pi/2, plane.ZAxis, plane.Origin)
        
        
        offset_vector_y = plane.XAxis * (Brick.REFERENCE_LENGTH-Brick.REFERENCE_WIDTH)/2
        
        rg.Plane.Translate(plane, offset_vector_y)
    
    myBrick = Brick(plane)
    bricks.append(myBrick.mesh())
# ---------- end bricks ----------
geo_2 = Geometry(bricks.bricks)
