# Grasshopper definition brick_L_Ilaria_lena.gh (Grasshopper 1.0.7)

geo = Geometry([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])
bricks = GhPythonScript(robot_base_geometry=geo)  # -> out, meshes, surfaces, planes, brick_pts, pick_plane, robot_crv, transformed_robot_base, mesh, crv; inputs robot_base_geometry: list of Brep
# ---------- bricks: Python ----------
from compas_rhino import unload_modules
unload_modules('model')

import Rhino.Geometry as rg
import Rhino.Collections as rc

from model import Brick





class L_Brick(plane):
# ---------- end bricks ----------
geo_2 = Geometry()
geo_3 = Geometry(bricks.pick_plane)
geo_4 = Geometry(bricks.mesh)
geo_5 = Geometry(bricks.surfaces)
geo_6 = Geometry(bricks.brick_pts)
geo_7 = Geometry(bricks.meshes)
geo_8 = Geometry(bricks.transformed_robot_base)
geo_9 = Geometry(bricks.planes)
geo_10 = Geometry(bricks.robot_crv)
item = ListItem(List=bricks.surfaces, Index=Slider(94, range=0..100), Wrap=True)
geo_11 = Geometry(item)
