# Grasshopper definition brick_L_Ilaria_lena.ghx (Grasshopper 1.0.7)

geo = Geometry([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])
bricks = GhPythonScript(robot_base_geometry=geo)  # -> out, geo; inputs robot_base_geometry: list of Brep
# ---------- bricks: Python ----------
from compas_rhino import unload_modules
unload_modules('model')

import Rhino.Geometry as rg
import Rhino.Collections as rc

from model import Brick
import math as m

x_vec = rg.Vector3d(1,0,0)
y_vec = rg.Vector3d(0,1,0)

plane_for_l = rg.Plane(rg.Point3d(0,0,100), x_vec, y_vec)

plane_for_test = rg.Plane(rg.Point3d(100,0,100), x_vec, y_vec)


class LBrick():
    def __init__(self, plane):
        self.plane = plane
        
    def create(self):
         myBrick = Brick(self.plane)
         brick_1 = myBrick.mesh()
         
         plane_for_brick_2 = rg.Plane.Clone(self.plane)
         
         moving_brick_2_vector_x = plane_for_brick_2.XAxis
         moving_brick_2_vector_y = plane_for_brick_2.YAxis
         
         rg.Plane.Translate(plane_for_brick_2, (Brick.REFERENCE_LENGTH/2 + Brick.REFERENCE_WIDTH/2) * moving_brick_2_vector_x)
         rg.Plane.Translate(plane_for_brick_2,  moving_brick_2_vector_y * (Brick.REFERENCE_LENGTH-Brick.REFERENCE_WIDTH)/2)
         
         
         
         rg.Plane.Rotate(plane_for_brick_2, m.radians(90),plane_for_brick_2.ZAxis, plane_for_brick_2.Origin)
         
         
         myBrick_2 = Brick(plane_for_brick_2)
         brick_2 = myBrick_2.mesh()
         
         
         return brick_1, brick_2
# ---------- end bricks ----------
geo_2 = Geometry(bricks.geo)
