# Grasshopper definition nina_robotick_brick_layering_test02.gh (Grasshopper 1.0.7)

curve = Curve(<curve referenced from the Rhino model>)
ghpython_script = GhPythonScript(curves=curve)  # -> out, planes, brick_points, planes_fromcrv; inputs curves: list of Curve
# ---------- ghpython_script: Python ----------
from compas_rhino import unload_modules
unload_modules('model')


import rhinoscriptsyntax as rs
import Rhino.Geometry as rg
from model import Brick

planes_fromcrv=[]
brick_points=[]

def curve_to_planes():
    brick_planes=[]
    for curve in curves:
        params= rg.Curve.DivideByLength(curve, Brick.REFERENCE_LENGTH + 3, False)
        print(params)
        for param in params:
            brick_pos=rg.Curve.PointAt(curve,param)
            brick_tan=rg.Curve.TangentAt(curve,param)
            vec1=rg.Vector3d.CrossProduct(brick_tan, rg.Vector3d.ZAxis)
            vec2=rg.Vector3d.CrossProduct(vec1, rg.Vector3d.ZAxis)
            plane=rg.Plane(brick_pos, vec2, vec1)
            
            brick_points.append(brick_pos)
            brick_planes.append(plane)
    return brick_planes
    
    
planes_fromcrv= curve_to_planes()
# ---------- end ghpython_script ----------

# ----
# Meshes
xcount = Slider(20, range=1..100)
ycount = Slider(4, range=1..100)
zcount = Slider(30, range=1..100)
curve_2 = Curve(<curve referenced from the Rhino model>)
geo = Geometry([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])
bricks = GhPythonScript(
    robot_base_geometry=geo,
    xcount=xcount,
    ycount=ycount,
    zcount=zcount,
    curve_tofollow=curve_2,
    planes_fromcrv=ghpython_script.planes_fromcrv)  # -> out, surfaces, planes, robot_crv, transformed_robot_base, meshes, normal_planes; inputs robot_base_geometry: list of Brep, xcount: Int32, ycount: Int32, zcount: Int32, planes_fromcrv: list
# ---------- bricks: Python ----------
from compas_rhino import unload_modules
unload_modules('model')

from model import Wall
from model import Fabrication
import random as r
import Rhino.Geometry as rg
import math
import rhinoscriptsyntax as rs

from model import Brick

blength= Brick.REFERENCE_LENGTH
bheight=Brick.REFERENCE_HEIGHT
bwidth=Brick.REFERENCE_WIDTH

planes=[]
meshes=[]
circle_pts=[]
a=[]
b=[]
c=[]


def circle_pt(n, rad):
    #####CREATING ALGORITHMIC CURVE___02
    #####SIMPLE VERTICAL CIRCLE
    ##rad = small rad
    ##R = big rad of the torus
    #
    

    for i in range(n):
        theta=math.radians(360)*i/n
        a.append (math.sin(theta)*rad ) 
        b.append (math.cos(theta)*rad) 
        c.append (math.cos(theta)*rad )
        
        point_big_circ=rg.Point3d(a[i],b[i],c[i])
        circle_pts.append(point_big_circ)
    circle_pts.append(rg.Point3d(a[0],b[0],c[0]))
    return circle_pts
    


if xcount>zcount:
    circle_pt(xcount,100)
    print ("xcount is bigger")
else:
    circle_pt(zcount,100)
    print ("zcount is bigger")
    
    

#############################################################################
###TRYING TO CREATE SCRIPT FOR BRICKS THAT FOLLOW RHINO CURVES###IGNORE THIS#
#############################################################################
class Brickcurve():
    def __init__(self, curve, point_number):
        self.point_number = point_number
        self.axis_curve = curve

        # create planes of axis curve 
        self.planes = self.create_curve_projection_planes()
        
    def create_curve_projection_planes(self):
        # first divide curve to the number of points that we want to ultimately create
        pts = rs.DivideCurve(self.axis_curve, self.point_number, True)
        
        # then find the parameter 't' of the curve on those points (a float that describes on which point of the curve each point lies)
        t_params = [rs.CurveClosestPoint(self.axis_curve, p) for p in pts]
        
        # then find the point on 't' + something_very_small (=0.01). This point is just a tiny bit further. 
        # Think of this as us taking another point on the curve, that is a liiiittle bit further than our initial point that was on 't'
        pts_next = [rs.EvaluateCurve(self.axis_curve, t + 0.01) for t in t_params]

        # then subtract the two points to get the curve normal vector
        curve_normals = [rg.Vector3d(p2[0] - p1[0], p2[1] - p1[1], p2[2] - p1[2]) for p1, p2 in zip(pts_next, pts)]
        
        # and finally with this normal vector create planes
        normal_planes = [rs.PlaneFromNormal(p, n) for p, n in zip(pts, curve_normals)]
        
        return normal_planes
        return pts

curve=Brickcurve(curve_tofollow,10)
curve.create_curve_projection_planes()


#############################################################################
#############################################################################
###THE ONE THAT LOOKS LIKE COLUMNS NEXT TO EACH OTHER###
def opt0():
    for i in range (zcount):
        for j in range(xcount):
            xpos= blength*j
            ypos=0
            zpos=bheight*i
            
    #        rotation=m.radians(r.random()*10)
            rotation=math.radians(b[i])
            
            plane_origin=rg.Point3d(xpos,ypos ,zpos)
            plane=rg.Plane(plane_origin, rg.Vector3d.XAxis, rg.Vector3d.YAxis)
            plane.Rotate(rotation, rg.Vector3d.ZAxis)
            
            MyBrick = Brick(plane)
            planes.append(MyBrick.picking_plane())
            meshes.append(MyBrick.mesh())

#############################################################################
###THE NICE PYRAMID SCREENSHOT###
def opt1():
    for i in range (zcount):
        for j in range (xcount -i):
            for k in range (ycount):
                
                rotation=[]
                
                xpos=blength*j + 15*i + a[i]*j*0.01
                ypos=bwidth*k + b[i]*k*0.1
                zpos=bheight*i
                
                rotation= math.radians(15*j)
               
                plane_origin=rg.Point3d(xpos, ypos , zpos)
                plane=rg.Plane(plane_origin, rg.Vector3d.XAxis, rg.Vector3d.YAxis)
                plane.Rotate(rotation, rg.Vector3d.ZAxis)
                
                MyBrick = Brick(plane)
                planes.append(MyBrick.picking_plane())
                meshes.append(MyBrick.mesh())
                
                

#############################################################################
###LOOKS LIKE STAIRS WITH ROTATING BRICKS###
def opt2():
    for i in range (zcount):
        for j in range (xcount-i):
            for k in range (ycount):
                
                rotation=[]
                
                xpos=blength*j + 25*i 
                ypos=bwidth*k
                zpos=bheight*i
                
                rotation= math.radians(6*j)
               
                plane_origin=rg.Point3d(xpos, ypos, zpos)
                plane=rg.Plane(plane_origin, rg.Vector3d.XAxis, rg.Vector3d.YAxis)
                plane.Rotate(rotation, rg.Vector3d.ZAxis)
                
                MyBrick = Brick(plane)
                planes.append(MyBrick.picking_plane())
                meshes.append(MyBrick.mesh())
#############################################################################
#############################################################################


def opt3():
    for i in range (zcount):
        for j in range(xcount):
            xpos= blength*j
            ypos=0
            zpos=bheight*i
            
    #        rotation=m.radians(r.random()*10)
            rotation=math.radians(b[i])
            
            plane_origin=rg.Point3d(xpos,ypos ,zpos)
            plane=rg.Plane(plane_origin, rg.Vector3d.XAxis, rg.Vector3d.YAxis)
            plane.Rotate(rotation, rg.Vector3d.ZAxis)
            
            MyBrick = Brick(plane)
            planes.append(MyBrick.picking_plane())
            meshes.append(MyBrick.mesh())
                
         
         

def opt1_crv():
    for i in range (zcount):
        for j in range (xcount):


                plane= planes_fromcrv[j]

                MyBrick = Brick(plane)
                planes.append(MyBrick.picking_plane())
                meshes.append(MyBrick.mesh())
                


opt1()
# ---------- end bricks ----------
plane = Plane(bricks.normal_planes)
geo_2 = Geometry(bricks.surfaces)
geo_3 = Geometry(bricks.planes)
item = ListItem(List=bricks.surfaces, Index=Slider(46, range=0..100), Wrap=True)
geo_4 = Geometry(item)
geometry = Geometry(bricks.meshes)

list_length = ListLength(List=ghpython_script.planes_fromcrv)
panel = Panel(list_length)
