# Grasshopper definition robotic_brick_laying.ghx (Grasshopper 1.0.7)

geo = Geometry([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])
bricks = GhPythonScript(robot_base_geometry=geo)  # -> out, surfaces, planes, robot_crv, transformed_robot_base; inputs robot_base_geometry: list of Brep
# ---------- bricks: Python ----------
from compas_rhino import unload_modules
unload_modules('model')

from model import Wall
from model import Fabrication
import Rhino.Geometry as rg



myWall = Wall(5,10)
surfaces, visualisation, robot_transformation = myWall.geometric_model()
#script, visualisation_robot_coordinate_system = myWall.fabrication_model()
#print(type(robot_transformation))
#planes, robot_crv = visualisation_robot_coordinate_system


#print (script)
transformed_robot_base = []
for geometry in robot_base_geometry:
    trans_geometry = geometry.Duplicate()
    trans_geometry.Transform(robot_transformation)
    transformed_robot_base.append(trans_geometry)
# ---------- end bricks ----------
geo_2 = Geometry(bricks.surfaces)
item = ListItem(List=bricks.surfaces, Index=Slider(94, range=0..100), Wrap=True)
geo_3 = Geometry(bricks.transformed_robot_base)
geo_4 = Geometry(bricks.planes)
geo_5 = Geometry(bricks.robot_crv)
geo_6 = Geometry(item)
