# Grasshopper definition robotic_brick_laying_grasshopper_version.ghx (Grasshopper 1.0.7)

geo = Geometry([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])
bricks = GhPythonScript(robot_base_geometry=geo)  # -> out, meshes, surfaces, planes, brick_pts, pick_plane, robot_crv, transformed_robot_base, mesh, crv; inputs robot_base_geometry: list of Brep
# ---------- bricks: Python ----------
from compas_rhino import unload_modules
unload_modules('model')

import Rhino.Geometry as rg
import Rhino.Collections as rc

from model import Brick

planes = []
meshes = []

for i in range (10):
    for j in range (20):
        if i % 2 == 1:
        
            x_value = (Brick.REFERENCE_LENGTH * j)+(1*j)+(Brick.REFERENCE_LENGTH/2)
        
            z_value = Brick.REFERENCE_HEIGHT * i + i*1
            
        else:
            
            x_value = (Brick.REFERENCE_LENGTH * j)+(1*j)
        
            z_value = Brick.REFERENCE_HEIGHT * i + i*1


        plane_origin = rg.Point3d(x_value, 0, z_value )
        plane = rg.Plane(plane_origin, rg.Vector3d.XAxis, rg.Vector3d.YAxis)
        myBrick = Brick(plane)
        planes.append(myBrick.picking_plane())
        meshes.append(myBrick.mesh())



pts = [rg.Point3d(0,0,0), rg.Point3d(200,200,0), rg.Point3d(200,400,0), rg.Point3d(0,200,0)]
pts = rc.Point3dList(pts)

crv = rg.BezierCurve(pts)
print crv
# ---------- end bricks ----------
geo_2 = Geometry()
geo_3 = Geometry(bricks.mesh)
geo_4 = Geometry(bricks.pick_plane)
geo_5 = Geometry(bricks.surfaces)
geo_6 = Geometry(bricks.brick_pts)
geo_7 = Geometry(bricks.meshes)
geo_8 = Geometry(bricks.transformed_robot_base)
geo_9 = Geometry(bricks.planes)
geo_10 = Geometry(bricks.robot_crv)
item = ListItem(List=bricks.surfaces, Index=Slider(94, range=0..100), Wrap=True)
geo_11 = Geometry(item)
