# Grasshopper definition planar_slicing_mini_fabrication.gh (Grasshopper 1.0.7)

data_folder_name = Panel("data")

# ---- group: Folder name
# Output
# Input
data = Data(data_folder_name)

# ----
number_slider = Slider(91, range=0..1000)
Z = UnitZ(Factor=1)
X = UnitX(Factor=1)
neg = Negative(Value=Z)

# ----
# Slicer
# Print points
panel = Panel("slicer_data.json")
py = PythonScript()  # -> path
# ---------- py: Python ----------
import sys
import os

ghComp = ghenv.Component
ghDoc = ghComp.OnPingDocument()

# the full path of the gh file
path = ghDoc.FilePath
# the current directory 
path = os.path.abspath(os.path.join(path, ".."))

print path
# ---------- end py ----------
load_print_points = GhPythonScript(recompute=Button(), path=py, folder_name=data, name="out_printpoints.json")  # -> out, geometry, points, frames, layer_heights, up_vectors, mesh_normals, closest_support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
# ---------- load_print_points: Python ----------
import os
import json
import rhinoscriptsyntax as rs
import Rhino.Geometry as rg
from compas.geometry import Frame

filename =os.path.join(os.path.join(path), folder_name , 'output', name)
print(filename)

# load data from json
with open(filename, 'r') as f:
    data = json.load(f)
print("Loaded Json: " + filename)

# geometry related data
points = []
frames = []
layer_heights = []
up_vectors = []
mesh_normals = []
closest_support = []

# fabrication related data
velocities = []
wait_times = []
blend_radiuses = []
extruder_toggles = []
feasibility = []


for i in range(len(data)):
    data_point = data[str(i)]
    
    # geometry related data
    point = rg.Point3d(data_point["point"][0], data_point["point"][1], data_point["point"][2])
    points.append(point)
    
    compas_frame = Frame.from_data(data_point["frame"])
    pt, x_axis, y_axis = compas_frame.point, compas_frame.xaxis, compas_frame.yaxis
    frame = rs.PlaneFromNormal(pt, rs.VectorCrossProduct(rg.Vector3d(x_axis[0], x_axis[1], x_axis[2]), rg.Vector3d(y_axis[0], y_axis[1], y_axis[2])))
    frames.append(frame)
    
    layer_height = data_point["layer_height"]
    layer_heights.append(layer_height)
    
    v = data_point["up_vector"]
    up_vector = rg.Vector3d(v[0], v[1], v[2])
    up_vectors.append(up_vector)
    
    v = data_point["mesh_normal"]
    mesh_normal = rg.Vector3d(v[0], v[1], v[2])
    mesh_normals.append(mesh_normal)
    
    cp = data_point["closest_support_pt"]
    if cp:
        cp_pt = rg.Point3d(cp[0], cp[1], cp[2])
        closest_support.append(cp_pt)
    
    # fabrication related data
    velocities.append(data_point["velocity"])
    wait_times.append(data_point["wait_time"])
    blend_radiuses.append(data_point["blend_radius"])
    extruder_toggles.append(data_point["extruder_toggle"])
    feasibility.append(data_point["is_feasible"])
    

# create full polyline
continuous_path_polyline = rs.AddPolyline(points)
# ---------- end load_print_points ----------
load_slicer_data = GhPythonScript(recompute=Button(), path=py, folder_name=data, name=panel)  # -> out, paths, all_points, mesh
# ---------- load_slicer_data: Python ----------
import os
import json
import rhinoscriptsyntax as rs
from compas.datastructures import Mesh
import Rhino.Geometry as rg
from compas_ghpython.artists import MeshArtist

filename =os.path.join(os.path.join(path), folder_name , 'output', name)
print(filename)
data = None

# load data from json
try:
    with open(filename, 'r') as f:
        data = json.load(f)
    print("Loaded Json: " + filename)
except:
    print('Attention! "' + filename + '"  does not exist')

paths = []
all_points = []
    
if data:
    if 'Mesh' in data:
        compas_mesh = Mesh.from_data(data['Mesh'])
        artist = MeshArtist(compas_mesh)
        mesh = artist.draw()
#        vs, fi = compas_mesh.to_vertices_and_faces()
#        mesh = rg.Mesh()
#        for f in fi:
#            gh_face = rg.MeshFace(f[0], f[1], f[2])
#            mesh.Faces.AddFace(gh_face)
#        for v in vs:
#            pt = rg.Point3d(v[0], v[1], v[2])
#            mesh.Vertices.Add(pt)
    
        
    if 'layers' in data:
        layers_data = data['layers']
    
        for i in range(len(layers_data)):
            layer_data = layers_data[str(i)]
            paths_data = layer_data['paths']
            for j in range(len(paths_data)):
                path_data = paths_data[str(j)]
                pts = []
    
                for k in range(len(path_data['points'])):
                    pt = path_data['points'][str(k)]
                    # re-create points
                    pt = rs.AddPoint(pt[0], pt[1], pt[2])
                    pts.append(pt)
                all_points.extend(pts)
                
                # create contour per layer
                try:
                    path = rs.AddPolyline(pts)
                except:
                    print('Attention! Could not add polyline at layer %d, path %d with %d points ' % (i, j, len(path_data['points'])))
                paths.append(path)
# ---------- end load_slicer_data ----------

pt = Point(load_slicer_data.all_points)
mesh = Mesh(load_slicer_data.mesh)
crv = Curve(load_slicer_data.paths)

# ----
# Tool Visualization
pt_2 = Point(pt)
pl = ConstructPlane(Origin=pt_2, XAxis=neg, YAxis=X)

print_planes = Plane(pl)
tool_mesh = Mesh(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)

# ---- group: Visualize mesh printing path
# Visualization
# Ligthweight path visualization
list = ValueList({"Visualize full path": 0, "Visualize part of path (set domain)": 1}, selected="Visualize full path")
# Heavy path visualization
sgements_resolution = Slider(14, range=0..20)
nozzle_diameter = Slider(1.5, range=0..10)
dom = ConstructDomain(DomainStart=Slider(0, range=0..100), DomainEnd=Slider(439, range=0..500))
subset = SubList(List=pt, Domain=dom, Wrap=True)  # -> List, Index
subset_2 = SubList(List=load_print_points.blend_radiuses, Domain=dom, Wrap=True)  # -> List, Index
filter = StreamFilter(Gate=list, Stream0=pt, Stream1=subset.List)
filter_2 = StreamFilter(Gate=list, Stream0=load_print_points.blend_radiuses, Stream1=subset_2.List)
python = GhPythonScript(points=filter, extruder_toggle_list=filter_2, nozzle_diameter=nozzle_diameter, segments=sgements_resolution)  # -> out, print_path_pipes, travel_path_lines; inputs points: list of Point3d, extruder_toggle_list: list
# ---------- python: Python ----------
__author__ = "joburger"
__version__ = "2020.10.12"

import Rhino.Geometry as rg

print_path_pipes = []
travel_path_lines = []

for i in range(len(points)-1):
    if extruder_toggle_list[i] == True:
        # if extruder_toggle is true, create line
        line = rg.Curve.CreateControlPointCurve([points[i], points[i+1]])
        # create meshpipe and append
        pipe = rg.Mesh.CreateFromCurvePipe(line, nozzle_diameter/2, segments, 1, rg.MeshPipeCapStyle.None, True)
        print_path_pipes.append(pipe)
    else:
        # if extruder_toggle is false, add to travel path list
        line = rg.Curve.CreateControlPointCurve([points[i], points[i+1]])
        travel_path_lines.append(line)
# ---------- end python ----------
geo = Geometry(python.travel_path_lines)
geo_2 = Geometry(python.print_path_pipes)
preview = CustomPreview(Geometry=geo_2, Material=ColourSwatch(SwatchColor=RGB(130, 130, 130)))
preview_2 = CustomPreview(Geometry=geo, Material=ColourSwatch(SwatchColor=RGB(255, 156, 36)))

# ----
deplane = DeconstructPlane(Plane=print_planes)  # -> Origin, XAxis, YAxis, ZAxis

points = Point(load_print_points.points)
frames = Plane(load_print_points.frames)
up_vectors = Vector(load_print_points.up_vectors)
mesh_normals = Vector(load_print_points.mesh_normals)
cpts = Point(load_print_points.closest_support)
layer_heights = Number(load_print_points.layer_heights)

wait_times = Number(load_print_points.wait_times)
extruder_toggles = Number(load_print_points.extruder_toggles)
feasibility = Boolean(load_print_points.feasibility)
velocities = Number(load_print_points.velocities)
blend_radiuses = Number(load_print_points.blend_radiuses)

tool_origin_only_for_visualization = Panel("""0.153792
-0.01069
-0.045507""")

# ---- group: tool visualization
# Tool visualization
button = Button()
python_2 = PythonScript(recompute=button, origin_coords=tool_origin_only_for_visualization, mesh=tool_mesh, planes=print_planes, i=number_slider)  # -> tool, mesh; inputs origin_coords: list, mesh: Mesh, planes: list of Plane, i: Int32
# ---------- python_2: Python ----------
import os
from compas.geometry import Frame
from compas.datastructures import Mesh
from compas_ghpython.artists import MeshArtist

import Rhino.Geometry as rg
import rhinoscriptsyntax as rs

origin = [float(origin_coords[0]), float(origin_coords[1]) , float(origin_coords[2])]
o = rg.Point3d(origin[0], origin[1], origin[2])
xaxis = [1, 0, 0]
x = rg.Vector3d(1, 0, 0)
yaxis = [0, 1, 0]
y = rg.Vector3d(0, 1, 0)

ee_frame = rg.Plane(o,x,y)
target_frame = planes[i]

T = rg.Transform.PlaneToPlane(ee_frame, target_frame)
S = rg.Transform.Scale(target_frame, 1000, 1000, 1000)

#rs.CopyObject(mesh)
mesh = rs.TransformObject(rs.CopyObject(mesh), T)
mesh = rs.TransformObject(rs.CopyObject(mesh), S)
# ---------- end python_2 ----------
mesh_2 = Mesh(python_2.mesh)
preview_3 = CustomPreview(Geometry=mesh_2, Material=ColourSwatch(SwatchColor=RGB(171, 171, 171)))

# ---- group: Path visualization
series = Series(Start=0, Step=1, Count=expr("x+1", number_slider))
item = ListItem(List=deplane.Origin, Index=series, Wrap=True)
pline = PolyLine(Vertices=item, Closed=False)

# ---- group: Select parameter
num = Number(velocities)

# ----
curvepoint = PointOnCurve(crv, parameter=0)
disc = Discontinuity(Curve=crv, Level=1)  # -> Points, Parameters
end = EndPoints(Curve=crv)  # -> Start, End
preview_4 = CustomPreview(Geometry=crv, Material=ColourSwatch(SwatchColor=RGB(189, 189, 189)))

# ---- group: Visualize section of print path
dom_2 = ConstructDomain(DomainStart=Slider(0, range=0..100), DomainEnd=Slider(151, range=0..500))
subset_3 = SubList(List=points, Domain=dom_2, Wrap=True)  # -> List, Index
pline_2 = PolyLine(Vertices=subset_3.List, Closed=False)

# ---- group: Visualize with text
tag_offset = Slider(1, range=0..100)
pdecon = Deconstruct(Point=points)  # -> XComponent, YComponent, ZComponent
addition = Addition(A=pdecon.ZComponent, B=tag_offset)
pt_3 = ConstructPoint(XCoordinate=pdecon.XComponent, YCoordinate=pdecon.YComponent, ZCoordinate=addition)
tag = TextTag(Location=pt_3, Text=num, Colour=ColourSwatch(SwatchColor=RGB(50, 130, 186)))

# ---- group: Visualize in color
bnd = Bounds(Numbers=num)
dedomain = DeconstructDomain(Domain=bnd)  # -> Start, End
gradient = Gradient(
    LowerLimit=dedomain.Start,
    UpperLimit=dedomain.End,
    Parameter=num,
    stops=[0: RGB(0, 128, 0), 0.5: RGB(255, 255, 0), 1: RGB(255, 0, 0)])
pt_4 = Point(load_print_points.points)
cloud = CloudDisplay(Points=pt_4, Colours=gradient, Size=Slider(1.29, range=0..10), SpriteType=0)

# ---- group: find duplicate pts
pt_5 = Point(pt)
cullpt = CullDuplicates(Points=pt_5, Tolerance="0.0001", CullMode=3)  # -> Points, Indices, Valence
python_3 = GhPythonScript(x=cullpt.Valence)  # -> out, a; inputs x: list
# ---------- python_3: Python ----------
__author__ = "Ioanna"
__version__ = "2020.10.19"

import rhinoscriptsyntax as rs  

a=[]
for i, v in enumerate(x):
    if v == 2:
        a.append(i)
# ---------- end python_3 ----------
item_2 = ListItem(List=pt_5, Index=python_3.a, Wrap=True)

# ---- group: Load points from json
py_2 = PythonScript()  # -> path; same code as py
# Helpers
load_points = GhPythonScript(recompute=Button(), path=py_2, folder_name=py, name="debug_pts.json")  # -> out, pts
# ---------- load_points: Python ----------
import os
import json
import rhinoscriptsyntax as rs
from compas.datastructures import Mesh
import Rhino.Geometry as rg

filename =os.path.join(os.path.join(path), folder_name , 'output', name)
print(filename)
data = None

# load data from json
try:
    with open(filename, 'r') as f:
        data = json.load(f)
    print("Loaded Json: " + filename)
except:
    print('Attention! "' + filename + '"  does not exist')


if data:
    pts = []
    for p in data:
        pts.append(rg.Point3d(p[0], p[1], p[2]))
# ---------- end load_points ----------

# ----
fabrication = GhPythonScript(points=points, velosities=velocities, blend_radiuses=blend_radiuses, extruder_toggles=extruder_toggles)  # -> out, rhino_base_way_planes, robot_planes; inputs points: list, velosities: list, blend_radiuses: list, extruder_toggles: list
# ---------- fabrication: Python ----------
from compas_rhino import unload_modules
unload_modules('simple_ur_script')
unload_modules('simple_comm')

import Rhino.Geometry as rg
import simple_comm as c
import simple_ur_script as ur

import math as m


def tcp(script):
    """ This funktion sets tcp 
    """
    script += ur.set_tcp_by_angles(
        0.0, 0.0, 74.0, m.radians(0.0), m.radians(180.0), m.radians(0))
    return script

def set_robot_base_plane_from_pts():

    pt_0 = rg.Point3d(299, 63, 0)  # base plane origin
    # point on base plane positive x direction
    pt_1 = rg.Point3d(499, 63, 0)
    pt_2 = rg.Point3d(499, 299, 0)  # point on base plane positive xy

    robot_base = rg.Plane(pt_0, pt_1-pt_0, pt_2-pt_0)
    return robot_base

def rhino_to_robot_space(rhino_plane):
    """ this funktion translates planes from the rhino cordinate system to
    the robot cordinate system 
    """
    robot_plane = rhino_plane.Clone()
    _r_matrix = rg.Transform.PlaneToPlane(
        rg.Plane.WorldXY, set_robot_base_plane_from_pts())
    
    robot_plane.Transform(_r_matrix)
    
    return robot_plane
    


def point_to_rhino_plane(point):
    rhino_plane = rg.Plane(point, rg.Vector3d.XAxis, rg.Vector3d.YAxis)
    return rhino_plane
    

def extrude(plane, vel, blend_radi, extr, script):
    
    vel = vel/1000
    blend_radi = blend_radi/1000
    script += ur.move_l_blend(plane, vel, blend_radi)
    
    if extr ==0:
        extr = False 
    else:
        extr = True
    script += ur.set_digital_out(4, extr)
    return script 


""" Robotic fabrication procedure
"""
script = ""

script = tcp(script)


"""Create rhino planes
"""

rhino_base_way_planes = []
for point in points:
    rhino_base_way_planes.append(point_to_rhino_plane(point))

"""Translate rhino planes to robot_plabe 
"""

robot_planes = []

for rhino_plane in rhino_base_way_planes:
    print rhino_plane.Origin
    robot_plane = rhino_to_robot_space(rhino_plane)
    print robot_plane.Origin
    robot_planes.append(robot_plane)
    
"""Create comands
"""

cnt = 0
for plane, velocity, blend_radi, extruder_toggle in zip(robot_planes, velosities,blend_radiuses, extruder_toggles):
    cnt += 1
    if cnt < 100:
        script = extrude(plane, velocity, blend_radi, extruder_toggle, script)


send = True
if send:
    script = c.concatenate_script(script)
    print script
    #c.send_script(script, "192.168.10.10")
# ---------- end fabrication ----------
geo_3 = Geometry(fabrication.rhino_base_way_planes)
geo_4 = Geometry(fabrication.robot_planes)
