# Grasshopper definition curved_slicing_solution.gh (Grasshopper 1.0.7)

# ----
# Inputs
py = PythonScript()  # -> path
# ---------- py: Python ----------
import sys
import os

ghComp = ghenv.Component
ghDoc = ghComp.OnPingDocument()

# the full path of the gh file
path = ghDoc.FilePath
# the current directory 
path = os.path.abspath(os.path.join(path, ".."))

print path
# ---------- end py ----------

# ---- group: Input mesh
mesh = Mesh(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)

# ---- group: Folder name
data = Data("data/")

# ----
# Input
mesh_2 = Mesh(mesh)

# ---- group: Path cross-section
# Visualization
xz = XZPlane(Origin=Point(0, 0, 0))
rectangle = Rectangle(Plane=xz, XSize=Slider(2.5, range=0..10), YSize=Slider(1, range=0..10), Radius=Slider(0.43, range=0..1))  # -> Rectangle, Length

# ----
X = UnitX(Factor=1)

# ----
# Load Printpoints
panel = Panel("out_printpoints.json")
csloadprintpoints = CsLoadPrintpoints(recompute=Button(), json_name=panel, path=py, folder_name=data)  # -> out, geometry, points, frames, layer_heights, up_vectors, mesh_normals, closest_support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; inputs recompute: Boolean
# ---------- csloadprintpoints: Python ----------
"""
Loads a dictionaly of Printpoints from a json file in the 'output' folder.
Requires to add '<path>/compas_slicer/src/grasshopper_visualization' to your python paths.
"""

import gh_compas_slicer
gh_compas_slicer = reload(gh_compas_slicer)


if path and folder_name and json_name:
    points, frames, layer_heights, up_vectors, mesh_normals, closest_support,velocities, wait_times, \
    blend_radiuses, extruder_toggles, feasibility = \
        gh_compas_slicer.load_printpoints(path, folder_name, json_name)
    
else:
    gh_compas_slicer.missing_input()
# ---------- end csloadprintpoints ----------

# ----
# Output
# Load Slicer
panel_2 = Panel("curved_slicer.json")

medges = MeshEdges(Mesh=mesh_2)  # -> NakedEdges, InteriorEdges, NonManifoldEdges

# ----
# Debugging
# Single distance list
button = Button()
offset = Slider(47.4, range=0..200)
csloadjsondata = CsLoadJsonData(recompute=button, json_name="distances_LOW.json", path=py, folder_name=data)  # -> out, data; inputs recompute: Boolean
# ---------- csloadjsondata: Python ----------
"""Loads a json file from the output folder. """

import gh_compas_slicer
gh_compas_slicer = reload(gh_compas_slicer)

if json_name and path and folder_name:
    data = gh_compas_slicer.load_json_file(path, folder_name, json_name)
else:
    gh_compas_slicer.missing_input()
# ---------- end csloadjsondata ----------
bnd = Bounds(Numbers=csloadjsondata.data)
bounds = Panel(bnd)
olffset = GhPythonScript(values=csloadjsondata.data, offset=offset)  # -> a; inputs values: list
# ---------- olffset: Python ----------
try:
    a = [v-offset for v in values]
except:
    print('could not perform offset')
# ---------- end olffset ----------

join = JoinCurves(Curves=flatten(medges.NakedEdges), Preserve=False)

# ----
# Simple interpolation
panel_3 = Panel("distances_HIGH.json")
weight = Slider(0.48, range=0..1)
csinterpolation = CsInterpolation(recompute=Button(), json_name1="distances_LOW.json", json_name2=panel_3, weight=weight, path=py, folder_name=data)  # -> out, interpolation; inputs recompute: Boolean
# ---------- csinterpolation: Python ----------
"""
Interpolation of the two distance fields that are loaded from the 'output' folder. 
Requires to add '<path>/compas_slicer/src/grasshopper_visualization' to your python paths.
"""

import gh_compas_slicer
gh_compas_slicer = reload(gh_compas_slicer)

if json_name1 and json_name2 and path and folder_name:
    interpolation = gh_compas_slicer.distance_fields_interpolation(path, folder_name, json_name1, json_name2, weight)
else:
    gh_compas_slicer.missing_input()
# ---------- end csinterpolation ----------

csloadslicer = CsLoadSlicer(recompute=Button(), json_name=panel_2, path=py, folder_name=data)  # -> out, mesh, paths, are_closed, all_points; inputs recompute: Boolean
# ---------- csloadslicer: Python ----------
"""
Loads a Slicer class from its json file in the 'output' folder.
Requires to add '<path>/compas_slicer/src/grasshopper_visualization' to your python paths.
"""

import gh_compas_slicer
gh_compas_slicer = reload(gh_compas_slicer)


if path and folder_name and json_name:
    mesh, paths, are_closed, all_points = gh_compas_slicer.load_slicer(path, folder_name, json_name)
    
else:
    gh_compas_slicer.missing_input()
# ---------- end csloadslicer ----------
item = ListItem(List=flatten(join), Index=0, Wrap=True)  # -> Item, Item1
# Export boundary vertices to json
number_slider = Slider(8, range=0..20)

crv = Curve(item.Item)
mesh_3 = Mesh(mesh_2)
crv_2 = Curve(item.Item1)

toggle = BooleanToggle(False)
panel_4 = Panel(csloadslicer.out)
panel_5 = Panel(csloadprintpoints.out)

mesh_4 = Mesh(csloadslicer.mesh)
paths = Curve(csloadslicer.paths)
all_points = Point(csloadslicer.all_points)

all_points_2 = Point(all_points)

points = Point(csloadprintpoints.points)
frames = Plane(csloadprintpoints.frames)
layer_heights = Number(csloadprintpoints.layer_heights)
up_vectors = Vector(csloadprintpoints.up_vectors)
mesh_normals = Vector(csloadprintpoints.mesh_normals)
cpts = Point(csloadprintpoints.closest_support)

up_vectors_2 = Vector(up_vectors)
pl = ConstructPlane(Origin=all_points_2, XAxis=X, YAxis=up_vectors_2)

print_planes = Plane(pl)
tool_mesh = Mesh(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)

# ----
# Tool Visualization
# Note: This is only an example. The actual tool orientation depends on the definition of the frame of your tool
number_slider_2 = Slider(1104, range=0..2000)
tool_origin = Panel("""0
0
99.507""")
cstoolviz = CsToolViz(origin_coords=tool_origin, mesh=tool_mesh, planes=print_planes, index=number_slider_2)  # -> out, mesh, passed_path; inputs origin_coords: list, mesh: Mesh, planes: list, index: Int32
# ---------- cstoolviz: Python ----------
"""
Example visualization of tool motion during the print.
Requires to add '<path>/compas_slicer/src/grasshopper_visualization' to your python paths.
"""

import gh_compas_slicer
gh_compas_slicer = reload(gh_compas_slicer)

if origin_coords and mesh and planes and (index or index==0):
    mesh, passed_path = gh_compas_slicer.tool_visualization(origin_coords, mesh, planes, index)
else:
    gh_compas_slicer.missing_input()
# ---------- end cstoolviz ----------

mesh_normals_2 = Vector(mesh_normals)
points_2 = Point(points)
section = Curve(rectangle.Rectangle)

velocities = Number(csloadprintpoints.velocities)
wait_times = Number(csloadprintpoints.wait_times)
blend_radiuses = Number(csloadprintpoints.blend_radiuses)
extruder_toggles = Number(csloadprintpoints.extruder_toggles)
feasibility = Boolean(csloadprintpoints.feasibility)

# ----
# Ligthweight Path Visualization
number_slider_3 = Slider(3.9, range=0..10)
extruder_toggles_2 = Number(extruder_toggles)
all_points_3 = Point(points)
cslightpathviz = CsLightPathViz(
    points=all_points_3,
    extruder_toggles=extruder_toggles_2,
    domain_start=Slider(0, range=0..100),
    domain_end=Slider(1421, range=0..2000),
    pipe_diameter=number_slider_3)  # -> out, print_path_pipes, travel_path_lines; inputs points: list of Point3d, extruder_toggles: list of Boolean, domain_start: Int32, domain_end: Int32
# ---------- cslightpathviz: Python ----------
"""
Creates a lightweight visualization of the print paths. Segments with extruder_toggle=True are visualized as pipes, 
segments with extruder_toggle=False are visualized as lines.
Loads files from the 'output' folder.
Requires to add '<path>/compas_slicer/src/grasshopper_visualization' to your python paths.
"""

import gh_compas_slicer
gh_compas_slicer = reload(gh_compas_slicer)

pipe_resolution = 14

if points:
    
    # assign default values to parameters where possible. 
    if not extruder_toggles:
        extruder_toggles = [False for i in range(len(points))]
    if not domain_start:
        domain_start = 0
    if not domain_end:
        domain_end = len(points)
    if not pipe_diameter:
        pipe_diameter = 2.0
        
    print_path_pipes, travel_path_lines = \
        gh_compas_slicer.lightweight_path_visualization(points, extruder_toggles, domain_start, domain_end, pipe_diameter, pipe_resolution)
    
else:
    gh_compas_slicer.missing_input()
# ---------- end cslightpathviz ----------

# ----
# Render Path Visualization
toggle_2 = BooleanToggle(False)
extruder_toggles_3 = Number(extruder_toggles)
layer_heights_2 = Number(layer_heights)
up_vectors_3 = Vector(up_vectors)
python = CsRenderPathViz(
    points=points_2,
    mesh_normals=mesh_normals_2,
    layer_heights=layer_heights_2,
    up_vectors=up_vectors_3,
    extruder_toggles=extruder_toggles_3,
    cross_section=section,
    planar_printing=toggle_2,
    compute=Toggle(True))  # -> out, loft_surfaces, travel_path_lines; inputs points: list of Point3d, mesh_normals: list of Vector3d, layer_heights: list, up_vectors: list of Vector3d, extruder_toggles: list of Boolean, cross_section: Curve, planar_printing: Boolean, compute: Boolean
# ---------- python: Python ----------
"""
Creates a render visualization of the print paths with loft surfaces where extruder_toggle=True.
For large number of points, this can take a while to compute, so keep it turned off unless you need it.
Loads files from the 'output' folder.
Requires to add '<path>/compas_slicer/src/grasshopper_visualization' to your python paths.
"""

import gh_compas_slicer
gh_compas_slicer = reload(gh_compas_slicer)

pipe_resolution = 14

if points and mesh_normals and layer_heights and extruder_toggles and cross_section:
    if compute:
        loft_surfaces, travel_path_lines = \
            gh_compas_slicer.render_path_visualization(points, mesh_normals, layer_heights, up_vectors, extruder_toggles, cross_section, planar_printing)
    else:
        print('Compute is set to False')
else:
    gh_compas_slicer.missing_input()
# ---------- end python ----------

# ---- group: Visualize boundaries
pipe = Pipe(Curve=join, Radius=Slider(0.3, range=0..1), Caps=0)
preview = CustomPreview(Geometry=pipe, Material=ColourSwatch(SwatchColor=RGB(0, 0, 0)))

# ----
ln = Line(StartPoint=points, EndPoint=cpts)
vdis = VectorDisplay(Anchor=points, Vector=expr("x*5", up_vectors))
cstargetinput = CsTargetInput(
    compute=toggle,
    mesh=mesh_3,
    targets=flatten(crv),
    resolution_mult=number_slider,
    path=py,
    folder_name=data,
    json_name="boundaryLOW.json")  # -> out, all_pts, target_vs, target_vi; inputs compute: Boolean, mesh: Mesh, targets: list of Curve, resolution_mult: Int32
# ---------- cstargetinput: Python ----------
"""
Creates a json file with the specified targets' information, needed for curved slicing with compas_slicer.
Requires to add '<path>/compas_slicer/src/grasshopper_visualization' to your python paths.
"""

import gh_compas_slicer
gh_compas_slicer = reload(gh_compas_slicer)


if compute:
    if mesh and targets and resolution_mult and path and folder_name and json_name:
        all_pts, target_vs, target_vi = \
        gh_compas_slicer.create_targets(mesh, targets, resolution_mult, path, folder_name, json_name)
    else:
        gh_compas_slicer.missing_input()
else:
    print('Compute is set to False')
# ---------- end cstargetinput ----------
cstargetinput_2 = CsTargetInput(
    compute=toggle,
    mesh=mesh_3,
    targets=flatten(crv_2),
    resolution_mult=number_slider,
    path=py,
    folder_name=data,
    json_name="boundaryHIGH.json")  # -> out, all_pts, target_vs, target_vi; inputs compute: Boolean, mesh: Mesh, targets: list of Curve, resolution_mult: Int32; same code as cstargetinput

# ----
# Visualize geodesic distances
distances = Number(olffset)
distances_2 = Number(csinterpolation.interpolation)

# ---- group: Color output
geo = Geometry(cslightpathviz.travel_path_lines)
geo_2 = Geometry(cslightpathviz.print_path_pipes)
preview_2 = CustomPreview(Geometry=geo_2, Material=ColourSwatch(SwatchColor=RGB(199, 199, 199)))
preview_3 = CustomPreview(Geometry=geo, Material=ColourSwatch(SwatchColor=RGB(255, 156, 36)))

geo_3 = Geometry(python.loft_surfaces)
geo_4 = Geometry(python.travel_path_lines)
preview_4 = CustomPreview(Geometry=geo_3, Material=ColourSwatch(SwatchColor=RGB(222, 222, 222)))
preview_5 = CustomPreview(Geometry=geo_4, Material=ColourSwatch(SwatchColor=RGB(255, 156, 36)))

# ----
mesh_5 = Mesh(cstoolviz.mesh)
geo_5 = Geometry(cstoolviz.passed_path)
preview_6 = CustomPreview(Geometry=mesh_5, Material=ColourSwatch(SwatchColor=RGB(171, 171, 171)))
preview_7 = CustomPreview(Geometry=geo_5, Material=ColourSwatch(SwatchColor=RGB(255, 156, 36)))

# ---- group: Select parameter
num = Number(extruder_toggles)

# ----
abs = Absolute(Value=distances_2)
pt = Point(cstargetinput_2.target_vs)
pt_2 = Point(cstargetinput.target_vs)

# ---- group: Visualize distance values on mesh
distances_3 = Number(abs)
mesh_6 = Mesh(mesh)

# ---- group: Visualize parameter with text
tag_offset = Slider(1, range=0..100)
pdecon = Deconstruct(Point=points)  # -> XComponent, YComponent, ZComponent
addition = Addition(A=pdecon.ZComponent, B=tag_offset)
pt_3 = ConstructPoint(XCoordinate=pdecon.XComponent, YCoordinate=pdecon.YComponent, ZCoordinate=addition)
tag = TextTag(Location=pt_3, Text=num, Colour=ColourSwatch(SwatchColor=RGB(50, 130, 186)))

# ---- group: Visualize parameter with color
bnd_2 = Bounds(Numbers=num)
avr = Average(Input=num)
dedomain = DeconstructDomain(Domain=bnd_2)  # -> Start, End
average = Panel(avr)
gradient = Gradient(
    LowerLimit=dedomain.Start,
    UpperLimit=dedomain.End,
    Parameter=num,
    stops=[0: RGB(0, 128, 0), 0.5: RGB(255, 255, 0), 1: RGB(255, 0, 0)])
pt_4 = Point(points)
cloud = CloudDisplay(Points=pt_4, Colours=gradient, Size=Slider(3.96, range=0..10), SpriteType=0)

# ---- group: Visualize distance values on mesh
bnd_3 = Bounds(Numbers=distances_3)
dedomain_2 = DeconstructDomain(Domain=bnd_3)  # -> Start, End
gradient_2 = Gradient(
    LowerLimit=dedomain_2.Start,
    UpperLimit=dedomain_2.End,
    Parameter=distances_3,
    stops=[0: RGB(0, 128, 0), 0.0566: RGB(255, 255, 0), 0.915: RGB(255, 0, 0)])
demesh = DeconstructMesh(Mesh=mesh_6)  # -> Vertices, Faces, Colours, Normals
conmesh = ConstructMesh(Vertices=demesh.Vertices, Faces=demesh.Faces, Colours=gradient_2)

# ---- group: Slicer data
len = Length(Curve=flatten(paths))
lng = ListLength(List=flatten(paths))
sum = GhPythonScript(x=len)  # -> out, a; inputs x: list
# ---------- sum: Python ----------
__author__ = "Ioanna"
__version__ = "2020.10.25"

import rhinoscriptsyntax as rs

a = 0
for v in x:
    a += v
# ---------- end sum ----------
total_path_length = Panel(sum.a)
total_number_of_paths = Panel(lng)

# ----
min = Panel(dedomain.Start)
max = Panel(dedomain.End)

# ----
# Load Points
button_2 = Button()
csloadjsonpoints = CsLoadJsonPoints(recompute=button_2, json_name="pts_boundary_HIGH_0.json", path=py, folder_name=data)  # -> out, points; inputs recompute: Boolean
# ---------- csloadjsonpoints: Python ----------
"""
Loads a json file that stores a dictionary of N points in the format: 
data['0']=[x0,y0,z0], ...,  data['N']=[xN,yN,zN]

Requires to add '<path>/compas_slicer/src/grasshopper_visualization' to your python paths.
"""

import gh_compas_slicer
gh_compas_slicer = reload(gh_compas_slicer)

if json_name and path and folder_name:
    points = gh_compas_slicer.load_json_points(path, folder_name, json_name)
else:
    gh_compas_slicer.missing_input()
# ---------- end csloadjsonpoints ----------
pt_5 = Point(csloadjsonpoints.points)

# ----
# Load Vectors
button_3 = Button()
csloadjsonvectors = CsLoadJsonVectors(recompute=button_3, json_name="gradient.json", path=py, folder_name=data)  # -> out, vectors; inputs recompute: Boolean
# ---------- csloadjsonvectors: Python ----------
"""
Loads a json file from the 'output' folder, 
that stores a vector field in the format: 
data['0']=[x0,y0,z0], ...,  data['N']=[xN,yN,zN]

Requires to add '<path>/compas_slicer/src/grasshopper_visualization' to your python paths.
"""

import gh_compas_slicer
gh_compas_slicer = reload(gh_compas_slicer)

if json_name and path and folder_name:
    vectors = gh_compas_slicer.load_json_vectors(path, folder_name, json_name)
else:
    gh_compas_slicer.missing_input()
# ---------- end csloadjsonvectors ----------
demesh_2 = DeconstructMesh(Mesh=mesh)  # -> Vertices, Faces, Colours, Normals
vdis_2 = VectorDisplay(Anchor=demesh_2.Vertices, Vector=csloadjsonvectors.vectors)

# ----
# Load Polylines
button_4 = Button()
csloadjsonpolylines = CsLoadJsonPolylines(recompute=button_4, json_name="point_clusters_polylines_0.json", path=py, folder_name=data)  # -> out, polylines, points; inputs recompute: Boolean
# ---------- csloadjsonpolylines: Python ----------
"""
Loads a json file that stores a dictionary of N polylines in the format:
data['0']=points_dict_0, ..., data['N'] = points_dict_N, where points_dict is in the format:
points_dict['0']=[x0,y0,z0], ...,  points_dict['N']=[xN,yN,zN]

Requires to add '<path>/compas_slicer/src/grasshopper_visualization' to your python paths.
"""

import gh_compas_slicer
gh_compas_slicer = reload(gh_compas_slicer)

if json_name and path and folder_name:
    polylines, points = gh_compas_slicer.load_json_polylines(path, folder_name, json_name)
else:
    gh_compas_slicer.missing_input()
# ---------- end csloadjsonpolylines ----------
crv_3 = Curve(csloadjsonpolylines.polylines)

# ----
# Load BaseBoundaries
button_5 = Button()

csloadjsonboundary = CsLoadJsonBoundary(recompute=button_5, path=py, folder_name=data)  # -> out, points, vectors, n; inputs recompute: Boolean
# ---------- csloadjsonboundary: Python ----------
"""
Loads a json file that stores a dictionary of BaseBoundary classes in the format:
data['0']=base_boundary_1.to_data(), ..., data['N']=base_boundary_N.to_data()

Requires to add '<path>/compas_slicer/src/grasshopper_visualization' to your python paths.
"""

import gh_compas_slicer
gh_compas_slicer = reload(gh_compas_slicer)

if json_name and path and folder_name:
    points, vectors, n = gh_compas_slicer.load_base_boundaries(path, folder_name, json_name)
else:
    gh_compas_slicer.missing_input()
# ---------- end csloadjsonboundary ----------

no_of_boundaries = Panel(csloadjsonboundary.n)
vdis_3 = VectorDisplay(Anchor=csloadjsonboundary.points, Vector=expr("x*3", csloadjsonboundary.vectors))
