# Grasshopper definition visualization.gh (Grasshopper 1.0.7)

# ---- group: FOLDER
data_folder_name = Panel("1_data_cylinder\")

data_folder_name_2 = Panel("2_data_bunny\")

# ---- group: Selection
list = ValueList({"1_data_cylinder": 0, "2_data_bunny": 1}, selected="1_data_cylinder")

# ----
_1_cylinder = Mesh(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)
_2_bunny = Mesh(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)
merge = Merge(Data1=flatten(data_folder_name), Data2=flatten(data_folder_name_2))
merge_2 = Merge(Data1=flatten(_1_cylinder), Data2=flatten(_2_bunny))
item = ListItem(List=merge, Index=list, Wrap=True)
item_2 = ListItem(List=merge_2, Index=list, Wrap=True)

# ----
# Inputs
py = PythonScript()  # -> path
# ---------- py: Python ----------
import sys
import os

ghComp = ghenv.Component
ghDoc = ghComp.OnPingDocument()

# the full path of the gh file
path = ghDoc.FilePath
# the current directory 
path = os.path.abspath(os.path.join(path, ".."))

print path
# ---------- end py ----------

# ---- group: Input mesh
mesh = Mesh(item_2)

# ---- group: Folder name
data = Data(item)
