# Grasshopper definition visualization.gh (Grasshopper 1.0.7)

data_folder_name = Panel("data")

# ---- group: Folder name
# Input
data = Data(data_folder_name)

# ----
# Slicer
# Print points
panel = Panel("slicer_data.json")
py = PythonScript()  # -> path
# ---------- py: Python ----------
import sys
import os

ghComp = ghenv.Component
ghDoc = ghComp.OnPingDocument()

# the full path of the gh file
path = ghDoc.FilePath
# the current directory 
path = os.path.abspath(os.path.join(path, ".."))

print path
# ---------- end py ----------
load_print_points = GhPythonScript(recompute=Button(), path=py, folder_name=data, name="out_printpoints.json")  # -> out, geometry, points, frames, layer_heights, up_vectors, mesh_normals, closest_support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
# ---------- load_print_points: Python ----------
import os
import json
import rhinoscriptsyntax as rs
import Rhino.Geometry as rg
from compas.geometry import Frame

filename =os.path.join(os.path.join(path), folder_name , 'output', name)
print(filename)

# load data from json
with open(filename, 'r') as f:
    data = json.load(f)
print("Loaded Json: " + filename)

# geometry related data
points = []
frames = []
layer_heights = []
up_vectors = []
mesh_normals = []
closest_support = []

# fabrication related data
velocities = []
wait_times = []
blend_radiuses = []
extruder_toggles = []
feasibility = []


for i in range(len(data)):
    data_point = data[str(i)]
    
    # geometry related data
    point = rg.Point3d(data_point["point"][0], data_point["point"][1], data_point["point"][2])
    points.append(point)
    
    compas_frame = Frame.from_data(data_point["frame"])
    pt, x_axis, y_axis = compas_frame.point, compas_frame.xaxis, compas_frame.yaxis
    frame = rs.PlaneFromNormal(pt, rs.VectorCrossProduct(rg.Vector3d(x_axis[0], x_axis[1], x_axis[2]), rg.Vector3d(y_axis[0], y_axis[1], y_axis[2])))
    frames.append(frame)
    
    layer_height = data_point["layer_height"]
    layer_heights.append(layer_height)
    
    v = data_point["up_vector"]
    up_vector = rg.Vector3d(v[0], v[1], v[2])
    up_vectors.append(up_vector)
    
    v = data_point["mesh_normal"]
    mesh_normal = rg.Vector3d(v[0], v[1], v[2])
    mesh_normals.append(mesh_normal)
    
    cp = data_point["closest_support_pt"]
    if cp:
        cp_pt = rg.Point3d(cp[0], cp[1], cp[2])
        closest_support.append(cp_pt)
    
    # fabrication related data
    velocities.append(data_point["velocity"])
    wait_times.append(data_point["wait_time"])
    blend_radiuses.append(data_point["blend_radius"])
    extruder_toggles.append(data_point["extruder_toggle"])
    feasibility.append(data_point["is_feasible"])
    

# create full polyline
continuous_path_polyline = rs.AddPolyline(points)
# ---------- end load_print_points ----------
load_slicer_data = GhPythonScript(recompute=Button(), path=py, folder_name=data, name=panel)  # -> out, paths, all_points, mesh
# ---------- load_slicer_data: Python ----------
import os
import json
import rhinoscriptsyntax as rs
from compas.datastructures import Mesh
import Rhino.Geometry as rg
from compas_ghpython.artists import MeshArtist

filename =os.path.join(os.path.join(path), folder_name , 'output', name)
print(filename)
data = None

# load data from json
try:
    with open(filename, 'r') as f:
        data = json.load(f)
    print("Loaded Json: " + filename)
except:
    print('Attention! "' + filename + '"  does not exist')

paths = []
all_points = []
    
if data:
    if 'mesh' in data:
        compas_mesh = Mesh.from_data(data['mesh'])
        artist = MeshArtist(compas_mesh)
        mesh = artist.draw()
#        vs, fi = compas_mesh.to_vertices_and_faces()
#        mesh = rg.Mesh()
#        for f in fi:
#            gh_face = rg.MeshFace(f[0], f[1], f[2])
#            mesh.Faces.AddFace(gh_face)
#        for v in vs:
#            pt = rg.Point3d(v[0], v[1], v[2])
#            mesh.Vertices.Add(pt)
    
        
    if 'layers' in data:
        layers_data = data['layers']
    
        for i in range(len(layers_data)):
            layer_data = layers_data[str(i)]
            paths_data = layer_data['paths']
            for j in range(len(paths_data)):
                path_data = paths_data[str(j)]
                pts = []
    
                for k in range(len(path_data['points'])):
                    pt = path_data['points'][str(k)]
                    # re-create points
                    pt = rs.AddPoint(pt[0], pt[1], pt[2])
                    pts.append(pt)
                all_points.extend(pts)
                
                # create contour per layer
                try:
                    path = rs.AddPolyline(pts)
                except:
                    print('Attention! Could not add polyline at layer %d, path %d with %d points ' % (i, j, len(path_data['points'])))
                paths.append(path)
# ---------- end load_slicer_data ----------

pt = Point(load_slicer_data.all_points)
mesh = Mesh(load_slicer_data.mesh)
crv = Curve(load_slicer_data.paths)

frames = Plane(load_print_points.frames)
up_vectors = Vector(load_print_points.up_vectors)
mesh_normals = Vector(load_print_points.mesh_normals)
cpts = Point(load_print_points.closest_support)
points = Point(load_print_points.points)
layer_heights = Number(load_print_points.layer_heights)

wait_times = Number(load_print_points.wait_times)
extruder_toggles = Number(load_print_points.extruder_toggles)
velocities = Number(load_print_points.velocities)
blend_radiuses = Number(load_print_points.blend_radiuses)
feasibility = Boolean(load_print_points.feasibility)

# ---- group: Select parameter
num = Number(extruder_toggles)

# ----
disc = Discontinuity(Curve=crv, Level=1)  # -> Points, Parameters
end = EndPoints(Curve=crv)  # -> Start, End
preview = CustomPreview(Geometry=crv, Material=ColourSwatch(SwatchColor=RGB(189, 189, 189)))
curvepoint = PointOnCurve(crv, parameter=0)

# ---- group: Visualize section of print path
dom = ConstructDomain(DomainStart=Slider(0, range=0..100), DomainEnd=Slider(2044, range=0..2045))
subset = SubList(List=points, Domain=dom, Wrap=True)  # -> List, Index
pline = PolyLine(Vertices=subset.List, Closed=False)

# ---- group: Visualize with text
tag_offset = Slider(1, range=0..100)
pdecon = Deconstruct(Point=points)  # -> XComponent, YComponent, ZComponent
addition = Addition(A=pdecon.ZComponent, B=tag_offset)
pt_2 = ConstructPoint(XCoordinate=pdecon.XComponent, YCoordinate=pdecon.YComponent, ZCoordinate=addition)
tag = TextTag(Location=pt_2, Text=num, Colour=ColourSwatch(SwatchColor=RGB(50, 130, 186)))

# ---- group: Visualize in color
bnd = Bounds(Numbers=num)
dedomain = DeconstructDomain(Domain=bnd)  # -> Start, End
gradient = Gradient(
    LowerLimit=dedomain.Start,
    UpperLimit=dedomain.End,
    Parameter=num,
    stops=[0: RGB(0, 128, 0), 0.5: RGB(255, 255, 0), 1: RGB(255, 0, 0)])
pt_3 = Point(load_print_points.points)
cloud = CloudDisplay(Points=pt_3, Colours=gradient, Size=Slider(1.29, range=0..10), SpriteType=0)
