# Grasshopper definition robotic_drawing_follow_crv.gh (Grasshopper 1.0.7)

geo = Geometry(<curve referenced from the Rhino model>)
robotic_drawing = GhPythonScript(send=Button(), CRV=geo)  # -> out, out_planes; inputs CRV: Curve
# ---------- robotic_drawing: Python ----------
# Uncomment the following 2 lines to reload the code in example.py
from compas_rhino import unload_modules
unload_modules('robotic_drawing')
unload_modules('simple_comm')
unload_modules('simple_ur_script')
unload_modules('robotic_drawing ')

import simple_ur_script as ur
import simple_comm as c

import Rhino.Geometry as rg
import rhinoscriptsyntax as rs

import math as m
import random as r

ROBOT_IP = "192.168.10.10"


#how to move the robot to a vertical position
def move_robot_vertical(move_to):
    script = ""
    script += ur.set_tcp_by_angles(0.0,0.0,0.0,m.radians(0.0),m.radians(180.0),m.radians(0))

    velocity = 0.05
    acceleration = 0.02
    robot_ip = ROBOT_IP

    plane = rg.Plane(move_to,rg.Vector3d.ZAxis)
    script += ur.move_l(plane,acceleration,velocity)

    script = c.concatenate_script(script)
    c.send_script(script,robot_ip)
    print script

#how to get the robot's position
def get_robot_position():
    robot_ip = ROBOT_IP
    data = c.listen_to_robot(robot_ip)


def set_robot_base_plane_gh():
    """
    funktion for measuring origin, the x direction and the way direction to set the robot baseplane. 
    The origin of this plan will match the origin of the plane in Rhino."""
    
    rs.MerssageBox("move robot to base plane origin, press OK when there",0)
    data = c.listen_to_robot(robot_ip)
    pose = data['pose']
    pt_1 = rg.Point3d(pose[0]*1000,pose[1]*1000,pose[2]*1000)
    print pt_1
    rs.MessageBox("move robot to base plane positive x direction, press OK when there",0)
    data = c.listen_to_robot(robot_ip)
    pose = data['pose']
    pt_2 = rg.Point3d(pose[0]*1000,pose[1]*1000,pose[2]*1000)
    print pt_2
    rs.MessageBox("move robot to base plane positive y direction, press OK when there",0)
    data = c.listen_to_robot(robot_ip)
    pose = data['pose']
    pt_3 = rg.Point3d(pose[0]*1000,pose[1]*1000,pose[2]*1000)
    print pt_3

    robot_base = rg.Plane(pt_1,pt_2-pt_1,pt_3-pt_1)
    
    return(robot_base)

#how to transform rhino to robot base coordinates
def rhino_to_robot_space(_plane,_robot_base):
    _r_matrix = rg.Transform.PlaneToPlane(rg.Plane.WorldXY,_robot_base)
    _plane.Transform(_r_matrix)
    return _plane

#how to randomly draw
def random_walk_draw(_robot_base,pen_height,_no_pts,vel,accel):
    way_pts = []
    for i in range(_no_pts):
        y_r = r.randint(50,247)
        x_r = r.randint(50,370)
        r_pt = rg.Point3d(50+5*i,y_r,pen_height)
        way_pts.append(r_pt)

    #way_pts.append(way_pts[-1]+rg.Point3d(0,0,150))
    #way_pts.insert(0,way_pts[0]+rg.Point3d(0,0,150))

    for i,pt in enumerate(way_pts):
        if i>0:
            rs.AddLine(way_pts[i-1],pt)

    way_planes = [rg.Plane(pt,rg.Vector3d.ZAxis) for pt in way_pts]
    way_planes = [rhino_to_robot_space(plane,_robot_base) for plane in way_planes]

    velocity = vel
    acceleration = accel
    robot_ip = ROBOT_IP

    script = ""
    script += ur.set_tcp_by_angles(0.0,0.0,pen_height,m.radians(0.0),m.radians(180.0),m.radians(0))

    for plane in way_planes:
        script += ur.move_l(plane,acceleration,velocity)

    script = c.concatenate_script(script)
    #c.send_script(script,robot_ip)
    return planes
    print script
    return planes
    
    
    
def follow_crv(_robot_base,pen_height,_no_pts,vel,accel):
    ### dived crv by count and return points ###
    resulution = 100
    params = CRV.DivideByCount(100, True) # this function riturns a list of paramters along the curve. Paramters are numbers wich correspond with positions along the curve.
    crv_pts = []   # This is a list for where we will apend the points that we will create along the length of the curve 
    for param in params:
        crv_pts.append(CRV.PointAt(param))
    
    
    ### create a plane for each pt in curve pts 
    way_planes = []
    for pt in crv_pts:
        way_planes.append(rg.Plane(pt, rg.Vector3d.ZAxis))
        
    ### translates the way_planes to the robot cordinate system 
    #translated_way_planes = []
    #for plane in way_planes:
        #print plane
        #translated_way_planes.append(rhino_to_robot_space(plane,_robot_base))
    
    
    ### creates a string with the robotic moves ###
    velocity = vel
    acceleration = accel
    robot_ip = ROBOT_IP

    script = ""
    script += ur.set_tcp_by_angles(0.0,0.0,pen_height,m.radians(0.0),m.radians(180.0),m.radians(0))

    for plane in way_planes:
        script += ur.move_l(plane,acceleration,velocity, 90,0)

    script = c.concatenate_script(script) ### formats the string into a multi line text format readable by the UR robot
    print script
    #c.send_script(script,robot_ip)
    return way_planes
robot_base = 0
follow_crv(robot_base,5.0,50,0.3,0.3)
    
    
    
#how to nicely draw
def nice_walk(_robot_base,pen_height,_no_pts,vel,accel):
    way_pts = []
    step_x = 150/_no_pts
    step_y = 237/_no_pts
    for i in range(_no_pts):
        if i%2 == 0:
            x_r = 30+step_x*i
            y_r = 30+step_y*i
            r_pt = rg.Point3d(x_r,y_r,pen_height)
            way_pts.append(r_pt)
        else:
            x_r = 30+step_x*i
            y_r = 150+60*m.sin(i)*-1
            r_pt = rg.Point3d(x_r,y_r,pen_height)
            way_pts.append(r_pt)

    #way_pts.append(way_pts[-1]+rg.Point3d(0,0,150))
    #way_pts.insert(0,way_pts[0]+rg.Point3d(0,0,150))

    for i,pt in enumerate(way_pts):
        if i>0:
            rs.AddLine(way_pts[i-1],pt)

    way_planes = [rg.Plane(pt,rg.Vector3d.ZAxis) for pt in way_pts]
    way_planes = [rhino_to_robot_space(plane,_robot_base) for plane in way_planes]

    velocity = vel
    acceleration = accel
    robot_ip = ROBOT_IP

    script = ""
    script += ur.set_tcp_by_angles(0.0,0.0,pen_height,m.radians(0.0),m.radians(180.0),m.radians(0))

    for plane in way_planes:
        script += ur. move_l(plane,acceleration,velocity)

    script = c.concatenate_script(script)
    c.send_script(script,robot_ip)
    print script


if send:
    robot_base = set_robot_base_plane()
    random_walk_draw(robot_base,5.0,50,0.3,0.3)






"""
rd.ROBOT_IP = '192.168.10.10'

move_to = rg.Point3d(300.0,60.0,300.0)
#rd.move_robot_vertical(move_to)

#rd.set_robot_base_plane()

#robot_base = rd.load_robot_base_plane()


zero_plane = rg.Plane(rg.Point3d(20,20,.3),rg.Vector3d.ZAxis)

plane_1 = rg.Plane(rg.Point3d(400.0,20.0,.3),rg.Vector3d.ZAxis)
plane_2 = rg.Plane(rg.Point3d(400.0,277,.3),rg.Vector3d.ZAxis)
plane_3 = rg.Plane(rg.Point3d(20,277,.3),rg.Vector3d.ZAxis)

way_planes = [zero_plane,plane_1,plane_2,plane_3]
robo_planes = []

#for way_plane in way_planes:
    #robo_plane = rd.rhino_to_robot_space(way_plane,robot_base)
    #robo_planes.append(robo_plane)


robo_planes *= 10

accel = 0.05
vel = 0.1

script = ''
for robo_plane in robo_planes:
    script += ur.move_l(robo_plane, accel, vel)

if execute:
    test = 90
    #script = c.concatenate_script(script)
    #c.send_script(script, rd.ROBOT_IP)
else:
    #script = c.concatenate_script(script)
    print script


#import random as r
#way_planes = []
#for i in range(100):
#    x = r.randint(50,370)
#    y = r.randint(50,247)
#    way_plane = rg.Plane(rg.Point3d(x,y,0.1),rg.Vector3d.ZAxis)
#    way_planes.append(way_plane)
#    way_plane = rg.Plane(rg.Point3d(x,y,100),rg.Vector3d.ZAxis)
#    way_planes.append(way_plane)



"""
# ---------- end robotic_drawing ----------
panel = Panel(robotic_drawing.out)
geo_2 = Geometry()
