# Grasshopper definition robotic_drawing_oriented_vectors.gh (Grasshopper 1.0.7)

geo = Geometry(<curve referenced from the Rhino model>)
geo_2 = Geometry(<point referenced from the Rhino model>)
robotic_drawing = GhPythonScript(send=Button(), CRV=geo, ATTRACTOR_PT=geo_2)  # -> out, vectors_for_display, points_for_display, planes_for_display; inputs CRV: Curve, ATTRACTOR_PT: Point3d
# ---------- robotic_drawing: Python ----------
# Uncomment the following 2 lines to reload the code in example.py
from compas_rhino import unload_modules
unload_modules('robotic_drawing')
unload_modules('simple_comm')
unload_modules('simple_ur_script')
unload_modules('robotic_drawing ')

import simple_ur_script as ur
import simple_comm as c
import Rhino.Geometry as rg
import math as m
import random as r

ROBOT_IP = "192.168.10.10"



way_pts = []
Points =[]
Lines=[]
Polyline = []
pen_height = 200.0

#Values to set the robot origin
ORIGIN = rg.Point3d(527, -92, 22)
X_AXIS = rg.Point3d(527, 400, 22)
Y_POSITIVE_PLANE = rg.Point3d(250, -92, 22)

way_plane_out = []

#Sets the robot origin
def set_robot_base():
    robot_base = rg.Plane(ORIGIN,X_AXIS-ORIGIN,Y_POSITIVE_PLANE-ORIGIN)
    print (robot_base)
    return (robot_base)

#how to transform rhino to robot base coordinates
def rhino_to_robot_space(_plane,robot_base):
    plane = _plane.Clone()
    _r_matrix = rg.Transform.PlaneToPlane(rg.Plane.WorldXY,robot_base)
    plane.Transform(_r_matrix)
    return plane



def follow_crv(_robot_base,pen_height,_no_pts,vel,accel):
    ### dived crv by count and return points ###
    resulution = 50
    params = CRV.DivideByCount(resulution, True)    # this function riturns a list of paramters along the curve. Paramters are numbers wich correspond with positions along the curve.
    crv_pts = []                                    # This is a list for where we will apend the points that we will create along the length of the curve 
    for param in params:
        crv_pts.append(CRV.PointAt(param))
    
    
    ### creates a list of vectors to orient the end effector ###
    way_planes = []
    oriented_vectors = []
    
    for pt in crv_pts:
        new_z_vec = ATTRACTOR_PT - pt 
        new_x_vec = rg.Vector3d.CrossProduct(rg.Vector3d.YAxis, new_z_vec)
        new_y_vec = rg.Vector3d.CrossProduct(new_z_vec, rg.Vector3d.XAxis)
        
        plane = rg.Plane(pt, new_x_vec, new_y_vec)
        way_planes.append(plane)
        oriented_vectors.append(new_z_vec)
        
    ### translates the way_planes to the robot cordinate system 
    translated_way_planes = []
    
    for plane in way_planes:
        translated_way_planes.append(rhino_to_robot_space(plane,_robot_base))
        
    ### creates a string with the robotic moves ###
    velocity = vel
    acceleration = accel
    robot_ip = ROBOT_IP
    blend = 0.005

    script = ""
    script += ur.set_tcp_by_angles(0.0,0.0,pen_height,m.radians(0.0),m.radians(180.0),m.radians(0))
    
    
    print script
    for plane in translated_way_planes:
        #script += ur.move_l(plane,acceleration,velocity)
        script += ur.move_l_blend(plane,acceleration,velocity,blend) 

    script = c.concatenate_script(script)
    c.send_script(script,robot_ip)
    return oriented_vectors, crv_pts, translated_way_planes

send = True
if send:
    robot_base =  set_robot_base()
    vectors_for_display, points_for_display, planes_for_display = follow_crv(robot_base,pen_height,50,0.3,0.3)
# ---------- end robotic_drawing ----------
vdisex = VectorDisplayEx(Point=robotic_drawing.points_for_display, Vector=robotic_drawing.vectors_for_display, Colour=RGB(0, 0, 0), Width=2)
pln = Plane(robotic_drawing.planes_for_display)
